# Grasshopper definition canopy_generator.gh (Grasshopper 1.0.8)

number_slider = Slider(200, range=0..1000)
number_slider_2 = Slider(1280, range=0..10000)
number_slider_3 = Slider(1280, range=0..10000)
srf = Surface(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)
Z = UnitZ(Factor=Slider(20, range=0..100))
number_slider_4 = Slider(50, range=0..1000)
neg = Negative(Value=Z)
move = Move(Geometry=srf, Motion=neg)  # -> Geometry, Transform
py3 = Python3Script(height=number_slider, width=number_slider)  # -> out, points; inputs height: Int32, width: Int32; disabled
# ---------- py3: Python ----------
"""Grasshopper Script"""
# requirements: numpy
import numpy as np
import rhinoscriptsyntax as rs
import ghpythonlib as gh
import math
import Rhino

h = height
w = width

def center(h, w):
    if h % 2 == 0:
        center_h = h // 2 - 1  
    else:
        center_h = h//2

    if w % 2 == 0:
        center_w = w // 2 - 1 
    else:
        center_w = w//2

    return center_h, center_w

center_h, center_w = center(int(h), int(w))


pattern = np.zeros((h, w, 3), dtype=np.uint8)
y, x = np.ogrid[:h, :w]
dist = np.sqrt( (y - center_h)**2 + (x )**2 )
dist_2 = np.sqrt( (y)**2 + (x - center_w)**2 )
gradient = dist / dist.max() * 255
pattern[:, :, 0] = 255 - gradient *4
# pattern[:, :, 1] = gradient *2
# pattern[:, :, 2] = gradient**2

gray = np.mean(pattern, axis=2)
z = gray / 255.0 * 1000
yy, xx = np.indices(z.shape)


coords = np.column_stack((xx.ravel(), yy.ravel(), z.ravel()))
points = [Rhino.Geometry.Point3d(x, y, z) for x, y, z in coords]
# ---------- end py3 ----------
py3_2 = Python3Script(height=number_slider, width=number_slider)  # -> out, points; inputs height: Int32, width: Int32; disabled
# ---------- py3_2: Python ----------
"""Grasshopper Script"""
import numpy as np
import rhinoscriptsyntax as rs
import ghpythonlib as gh
import math
import Rhino

h = height
w = width

def center(h, w):
    if h % 2 == 0:
        center_h = h // 2 - 1  
    else:
        center_h = h//2

    if w % 2 == 0:
        center_w = w // 2 - 1 
    else:
        center_w = w//2

    return center_h, center_w

center_h, center_w = center(int(h), int(w))

def blur(array, kernel=3):
    pad = kernel // 2
    padded = np.pad(array, pad, mode='edge')
    out = np.zeros_like(array)
    for i in range(array.shape[0]):
        for j in range(array.shape[1]):
            window = padded[i:i+kernel, j:j+kernel]
            out[i, j] = np.mean(window)
    return out


# create UV grid
def uv_grid(divU, divV):
    u = np.linspace(0, 1, divU)
    v = np.linspace(0, 1, divV)
    U, V = np.meshgrid(u, v)
    return U, V


pattern = np.zeros((h, w, 3), dtype=np.uint8)
dist = math.sqrt(h**2 + w**2)
for i in range(h):
    for j in range(w):
        d = math.sqrt(i**2 + j**2)
        intensity = int((d / dist) * 255)
        pattern[i, j] = [intensity, intensity, 255]

gray = np.mean(pattern, axis=2)
z = gray / 255.0 * 100
z = blur(z, 5)
yy, xx = np.indices(z.shape)


coords = np.column_stack((xx.ravel(), yy.ravel(), z.ravel()))
points = [Rhino.Geometry.Point3d(x, y, z) for x, y, z in coords]
# origin = rs.AddPoint((0,0,0))
# transformed_points = rs.ScaleObjects(points, origin, (100,100,100), True)
# points = transformed_points

U, V = uv_grid(h, w)
# ---------- end py3_2 ----------
py3_3 = Python3Script(height=number_slider, width=Slider(100, range=0..1000))  # -> out, points, lowest_pts, surface, surface_points, mesh_lines; inputs height: Int32, width: Int32
# ---------- py3_3: Python ----------
"""
Assignment 3: Parametric Structural Canopy — Pseudocode Scaffold

Author: Joseph Naguib

"""

#r: numpy
import Rhino
import numpy as np
import rhinoscriptsyntax as rs
import random

U = height
V = width

# create a sinewave gradient heightmap
def create_heightmap(U, V):
    x = np.linspace(0, 4 * np.pi, U)
    y = np.linspace(0, 4 * np.pi, V)
    X, Y = np.meshgrid(x, y)
    Z = (1*np.sin(X) + 2.5*np.cos(Y)) * U/50  # Amplitude of 5 units
    return Z


# get n minimum points in heightmap
def get_lowest_n(heightmap, n):
    flat = heightmap.ravel()
    idx = np.argsort(flat)[:n]
    return np.column_stack(np.unravel_index(idx, heightmap.shape))

# sample points from surface
def sample_point_grid_from_surface(base_surface, U, V):
    #get domain of base_surface
    u_d0, u_d1 = rs.SurfaceDomain(base_surface, 0)
    v_d0, v_d1 = rs.SurfaceDomain(base_surface, 1) 
    p_u =[u_d0 + (u_d1 - u_d0) * (i / float(U)) for i in range(U+1)]
    p_v =[v_d0 + (v_d1 - v_d0) * (i / float(V)) for i in range(V+1)]
    points = []
    for u in p_u:
        row = []
        for v in p_v:
            x, y, z = rs.EvaluateSurface(base_surface, u, v)
            pt = Rhino.Geometry.Point3d(float(x), float(y), float(z))
            row.append(pt)
        points.append(row)
        
    return points

# flatten points
def flatten_pts(points):  
    flt_pts= [pt for row in points for pt in row]
    return flt_pts

# create mesh lines from surface UV points
def mesh_lines_from_surface_uv_points(uv_points):
    lines = []
    U = len(uv_points)
    V = len(uv_points[0])
    for i in range(U):
        for j in range(V - 1):
            pt1 = uv_points[i][j]
            pt2 = uv_points[i][j + 1]
            line = rs.AddLine(pt1, pt2)
            lines.append(line)
    for j in range(V):
        for i in range(U - 1):
            pt1 = uv_points[i][j]
            pt2 = uv_points[i + 1][j]
            line = rs.AddLine(pt1, pt2)
            lines.append(line)
    return lines


heightmap = create_heightmap(U, V)
# print(heightmap[1])
z = heightmap 
yy, xx = np.indices(z.shape)


coords = np.column_stack((xx.ravel(), yy.ravel(), z.ravel()))
print (coords)
points = [Rhino.Geometry.Point3d(x, y, z) for x, y, z in coords]


lowest_idx = get_lowest_n(heightmap, 4)
lowest_pts = [
    Rhino.Geometry.Point3d(float(j), float(i), float(heightmap[i, j]))
    for i, j in lowest_idx
]

surface = rs.AddSrfPtGrid(([V, U]), points, degree=(3,3))
surface_points_list = sample_point_grid_from_surface(surface, U, V*2)
surface_points = flatten_pts(surface_points_list)
# print (surface_points[0])
mesh_lines = mesh_lines_from_surface_uv_points(surface_points_list)
# ---------- end py3_3 ----------
py3_4 = Python3Script(
    srf=move.Geometry,
    U=number_slider_4,
    V=number_slider_4,
    amp=Slider(5, range=0..10),
    freq_u=Slider(0.1, range=0..1),
    freq_v=Slider(0.1, range=0..1),
    tessellation_type=Slider(0, range=0..1),
    heightmap_type=Slider(0, range=0..100),
    seed=Slider(4, range=0..100),
    rec_depth=Slider(4, range=0..100),
    n_branches=Slider(3, range=0..10),
    branch_start_height=Slider(12, range=0..100),
    extension_length=Slider(10, range=0..10),
    main_stem_diameter=Slider(1.5, range=0..10),
    smooth_control=Slider(3, range=0..10))  # -> out_points_flat, out_points_tree, out_heightmap, out_panels, out_mesh, out_root_points, out_root_points_ground, out_root_trunks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
# ---------- py3_4: Python ----------
import Rhino
import Rhino.Geometry as rg
import rhinoscriptsyntax as rs
import numpy as np

from Grasshopper import DataTree
from Grasshopper.Kernel.Data import GH_Path

# ---------------------------------------------------------------------------
# OUTPUT VARIABLES
# ---------------------------------------------------------------------------
canopy_srf = None
canopy_pts_flat = []
canopy_pts_tree = DataTree[object]()
H_out = []
root_points = []
root_points_ground = []
root_trunks = []
support_branches = []
supports = DataTree[object]()
support_sweeps = None
support_smooth = None

def coerce_face_or_surface(geo):
    g = getattr(geo, "Geometry", geo)
    try:
        import System
        if isinstance(g, System.Guid):
            g = rs.coercesurface(g) or rs.coercebrep(g)
    except:
        pass
    if isinstance(g, rg.Brep) and g.Faces.Count > 0:
        return g.Faces[0]
    return g

def eval_point_normal(srf_obj, u, v):
    pt = srf_obj.PointAt(u, v)
    n = srf_obj.NormalAt(u, v)
    if (not n.IsValid) or n.IsZero:
        n = rg.Vector3d(0, 0, 1)
    else:
        n.Unitize()
    return pt, n

def generate_heightmap(du0, du1, dv0, dv1, U, V, amp, freq_u, freq_v, heightmap_type, seed):
    np.random.seed(int(seed) if seed is not None else 0)
    u_vals = np.linspace(du0, du1, U + 1)
    v_vals = np.linspace(dv0, dv1, V + 1)
    Ug, Vg = np.meshgrid(u_vals, v_vals, indexing="ij")

    if int(heightmap_type) == 0:
        H = amp * np.sin(freq_u * Ug) * np.cos(freq_v * Vg)
    else:
        cu = 0.5 * (du0 + du1)
        cv = 0.5 * (dv0 + dv1)
        R = np.sqrt((Ug - cu) ** 2 + (Vg - cv) ** 2)
        mx = np.max(R) if np.max(R) != 0 else 1.0
        falloff = 1.0 - (R / mx)
        noise = (np.random.rand(*R.shape) - 0.5) * 2.0
        H = amp * falloff * noise

    return Ug, Vg, H

def build_surface_candidates(pts_grid, u_count, v_count, deg_u, deg_v):
    # Candidate A uses i-major flattening.
    pts_a = [pts_grid[i][j] for i in range(u_count) for j in range(v_count)]
    # Candidate B uses j-major flattening.
    pts_b = [pts_grid[i][j] for j in range(v_count) for i in range(u_count)]

    srf_a = rg.NurbsSurface.CreateThroughPoints(pts_a, u_count, v_count, deg_u, deg_v, False, False)
    srf_b = rg.NurbsSurface.CreateThroughPoints(pts_b, u_count, v_count, deg_u, deg_v, False, False)

    return srf_a, pts_a, srf_b, pts_b

def loft_surface_from_grid(pts_grid, u_count, v_count, along_u=True):
    section_curves = []
    if along_u:
        for i in range(u_count):
            row_pts = [pts_grid[i][j] for j in range(v_count)]
            pl = rg.Polyline(row_pts)
            if pl.IsValid and pl.Count >= 2:
                section_curves.append(pl.ToNurbsCurve())
    else:
        for j in range(v_count):
            col_pts = [pts_grid[i][j] for i in range(u_count)]
            pl = rg.Polyline(col_pts)
            if pl.IsValid and pl.Count >= 2:
                section_curves.append(pl.ToNurbsCurve())

    if len(section_curves) < 2:
        return None

    loft = rg.Brep.CreateFromLoft(
        section_curves,
        rg.Point3d.Unset,
        rg.Point3d.Unset,
        rg.LoftType.Normal,
        False
    )
    if loft and len(loft) > 0 and loft[0] and loft[0].IsValid:
        return loft[0]
    return None

def first_face_surface(brep_obj):
    if brep_obj and isinstance(brep_obj, rg.Brep) and brep_obj.Faces.Count > 0:
        return brep_obj.Faces[0].ToNurbsSurface()
    return None

def is_finite_point(p):
    # Check both Rhino validity and finite numeric values.
    if p is None or (not p.IsValid):
        return False
    x, y, z = p.X, p.Y, p.Z
    if (x != x) or (y != y) or (z != z):
        return False
    if abs(x) > 1e12 or abs(y) > 1e12 or abs(z) > 1e12:
        return False
    return True

def as_int(value, default, min_value=None):
    try:
        out = int(value)
    except (TypeError, ValueError):
        out = int(default)
    if min_value is not None and out < min_value:
        out = int(min_value)
    return out

def as_float(value, default, min_value=None):
    try:
        out = float(value)
    except (TypeError, ValueError):
        out = float(default)
    if min_value is not None and out < min_value:
        out = float(min_value)
    return out

def heightmap_local_minima_indices(H):
    rows, cols = H.shape
    minima = []
    if rows < 3 or cols < 3:
        idx = np.unravel_index(np.argmin(H), H.shape)
        return [(int(idx[0]), int(idx[1]), float(H[idx]))]

    for i in range(1, rows - 1):
        for j in range(1, cols - 1):
            h_ij = float(H[i, j])
            is_local_min = True
            for di in (-1, 0, 1):
                for dj in (-1, 0, 1):
                    if di == 0 and dj == 0:
                        continue
                    ni = i + di
                    nj = j + dj
                    if float(H[ni, nj]) < h_ij:
                        is_local_min = False
                        break
                if not is_local_min:
                    break
            if is_local_min:
                minima.append((i, j, h_ij))

    if not minima:
        idx = np.unravel_index(np.argmin(H), H.shape)
        minima = [(int(idx[0]), int(idx[1]), float(H[idx]))]

    minima.sort(key=lambda x: x[2])
    return minima

def dedupe_line_curves(curves, precision=6):
    out = []
    seen = set()
    for c in curves:
        if c is None:
            continue
        p0 = c.PointAtStart
        p1 = c.PointAtEnd
        key = (
            round(p0.X, precision), round(p0.Y, precision), round(p0.Z, precision),
            round(p1.X, precision), round(p1.Y, precision), round(p1.Z, precision)
        )
        if key in seen:
            continue
        seen.add(key)
        out.append(c)
    return out

def build_projected_boundary_curve_from_grid(pts_grid):
    if not pts_grid:
        return None
    rows = len(pts_grid)
    cols = len(pts_grid[0]) if rows > 0 else 0
    if rows < 2 or cols < 2:
        return None

    perimeter = []
    for i in range(rows):
        perimeter.append(pts_grid[i][0])
    for j in range(1, cols):
        perimeter.append(pts_grid[rows - 1][j])
    for i in range(rows - 2, -1, -1):
        perimeter.append(pts_grid[i][cols - 1])
    for j in range(cols - 2, 0, -1):
        perimeter.append(pts_grid[0][j])

    projected = []
    for p in perimeter:
        if p is None:
            continue
        projected.append(rg.Point3d(float(p.X), float(p.Y), 0.0))
    if len(projected) < 3:
        return None

    poly = rg.Polyline(projected + [projected[0]])
    if not poly.IsValid or poly.Count < 4:
        return None
    return poly.ToNurbsCurve()

def curve_within_projected_boundary(curve, boundary_crv, tol=1e-3, sample_count=7):
    if curve is None:
        return False
    if boundary_crv is None:
        return True
    if sample_count < 2:
        sample_count = 2

    dom = curve.Domain
    t0 = float(dom.T0)
    t1 = float(dom.T1)
    plane = rg.Plane.WorldXY

    for i in range(sample_count):
        u = float(i) / float(sample_count - 1)
        t = t0 + (t1 - t0) * u
        p = curve.PointAt(t)
        p_xy = rg.Point3d(float(p.X), float(p.Y), 0.0)
        inside = boundary_crv.Contains(p_xy, plane, tol)
        if inside == rg.PointContainment.Outside:
            return False
    return True

def cull_branches_outside_projected_boundary(curves, boundary_crv, tol=1e-3):
    if not curves:
        return []
    if boundary_crv is None:
        return list(curves)
    kept = []
    for c in curves:
        if curve_within_projected_boundary(c, boundary_crv, tol=tol, sample_count=7):
            kept.append(c)
    return kept

def cull_level_map_outside_projected_boundary(level_map, boundary_crv, tol=1e-3):
    if not level_map:
        return {}
    if boundary_crv is None:
        return dict(level_map)
    out = {}
    for level in level_map.keys():
        kept = cull_branches_outside_projected_boundary(level_map[level], boundary_crv, tol=tol)
        if kept:
            out[level] = kept
    return out

def trim_branches_to_mesh(curves, mesh_obj, tol=1e-3, cull_non_intersecting=False):
    if not curves:
        return []
    if mesh_obj is None or (not isinstance(mesh_obj, rg.Mesh)) or mesh_obj.Vertices.Count == 0:
        return list(curves)

    mesh_vertices = [rg.Point3d(v.X, v.Y, v.Z) for v in mesh_obj.Vertices]
    if not mesh_vertices:
        return list(curves)

    def closest_mesh_vertex(pt):
        closest = None
        best_d2 = None
        for mv in mesh_vertices:
            dx = mv.X - pt.X
            dy = mv.Y - pt.Y
            dz = mv.Z - pt.Z
            d2 = (dx * dx) + (dy * dy) + (dz * dz)
            if (best_d2 is None) or (d2 < best_d2):
                best_d2 = d2
                closest = mv
        return closest

    trimmed = []
    for c in curves:
        if c is None:
            continue

        p0 = c.PointAtStart
        p1 = c.PointAtEnd
        if p0.DistanceTo(p1) <= tol:
            continue

        line = rg.Line(p0, p1)
        hit_raw = None
        try:
            hit_raw = rg.Intersect.Intersection.MeshLine(mesh_obj, line)
        except:
            hit_raw = None

        hit_pts = []
        def collect_meshline_hits(obj):
            if obj is None:
                return
            if isinstance(obj, rg.Point3d):
                hit_pts.append(obj)
                return
            if isinstance(obj, (int, float)):
                t = float(obj)
                if (-tol <= t) and (t <= 1.0 + tol):
                    hit_pts.append(line.PointAt(t))
                return
            try:
                it = iter(obj)
            except TypeError:
                try:
                    t = float(obj)
                    if (-tol <= t) and (t <= 1.0 + tol):
                        hit_pts.append(line.PointAt(t))
                except:
                    pass
                return
            for sub in it:
                collect_meshline_hits(sub)

        collect_meshline_hits(hit_raw)

        if not hit_pts:
            if not cull_non_intersecting:
                trimmed.append(c)
            continue

        first_hit = None
        best_d = None
        for hp in hit_pts:
            d = p0.DistanceTo(hp)
            if (best_d is None) or (d < best_d):
                best_d = d
                first_hit = hp

        if first_hit is None:
            if not cull_non_intersecting:
                trimmed.append(c)
            continue

        snapped_hit = closest_mesh_vertex(first_hit)
        if snapped_hit is None:
            if not cull_non_intersecting:
                trimmed.append(c)
            continue

        if p0.DistanceTo(snapped_hit) > tol:
            trimmed.append(rg.Line(p0, snapped_hit).ToNurbsCurve())

    return dedupe_line_curves(trimmed)

def build_root_stems_to_branch_start(
    root_ground_pts,
    root_top_pts,
    branch_start_height,
    boundary_crv=None,
    tol=1e-3
):
    stems = []
    kept_ground_pts = []
    kept_top_pts = []
    root_count = min(len(root_ground_pts), len(root_top_pts))
    for idx in range(root_count):
        p_ground = root_ground_pts[idx]
        p_top = root_top_pts[idx]
        trunk_vec = rg.Vector3d(p_top - p_ground)
        trunk_len = trunk_vec.Length
        if trunk_len <= 1e-6:
            continue

        trunk_dir = rg.Vector3d(trunk_vec)
        trunk_dir.Unitize()
        start_dist = min(max(float(branch_start_height), 0.0), trunk_len)
        p_start = p_ground + trunk_dir * start_dist

        if boundary_crv is not None:
            p_xy = rg.Point3d(float(p_start.X), float(p_start.Y), 0.0)
            inside = boundary_crv.Contains(p_xy, rg.Plane.WorldXY, tol)
            if inside == rg.PointContainment.Outside:
                continue

        if p_ground.DistanceTo(p_start) > 1e-6:
            stems.append(rg.Line(p_ground, p_start).ToNurbsCurve())

        kept_ground_pts.append(p_ground)
        kept_top_pts.append(p_top)

    return stems, kept_ground_pts, kept_top_pts

def level_map_to_tree(level_map, first_level_curves=None, reverse_recursive=True):
    tree = DataTree[object]()
    branch_idx = 0

    if first_level_curves:
        path0 = GH_Path(branch_idx)
        for crv in first_level_curves:
            if crv is not None:
                tree.Add(crv, path0)
        branch_idx += 1

    for level in sorted(level_map.keys(), reverse=bool(reverse_recursive)):
        path = GH_Path(branch_idx)
        for crv in level_map.get(level, []):
            tree.Add(crv, path)
        branch_idx += 1
    return tree

def sweep_supports_to_tree(
    level_map,
    first_level_curves=None,
    reverse_recursive=True,
    first_diameter=1.0,
    last_diameter=0.2,
    abs_tol=1e-3,
    ang_tol_rad=0.1
):
    tree = DataTree[object]()
    groups = []

    if first_level_curves:
        group0 = [c for c in first_level_curves if c is not None]
        if group0:
            groups.append(group0)

    for level in sorted(level_map.keys(), reverse=bool(reverse_recursive)):
        grp = [c for c in level_map.get(level, []) if c is not None]
        if grp:
            groups.append(grp)

    n = len(groups)
    if n == 0:
        return tree

    d0 = max(0.0, float(first_diameter))
    d1 = max(0.0, float(last_diameter))

    for idx in range(n):
        if n == 1:
            dia = d0
        else:
            t = float(idx) / float(n - 1)
            dia = d0 + (d1 - d0) * t
        radius = 0.5 * max(0.0, dia)
        if radius <= 1e-9:
            continue

        path = GH_Path(idx)
        for rail in groups[idx]:
            try:
                breps = rg.Brep.CreatePipe(
                    rail,
                    radius,
                    False,
                    rg.PipeCapMode.Flat,
                    True,
                    float(abs_tol),
                    float(ang_tol_rad)
                )
            except:
                breps = None

            if not breps:
                continue
            for b in breps:
                if b is not None and b.IsValid:
                    tree.Add(b, path)

    return tree

def collect_tree_geometry(tree):
    out = []
    if tree is None:
        return out

    try:
        for br in tree.Branches:
            if br is None:
                continue
            for g in br:
                if g is not None:
                    out.append(g)
        return out
    except:
        pass

    try:
        for i in range(int(tree.BranchCount)):
            br = tree.Branch(i)
            if br is None:
                continue
            for g in br:
                if g is not None:
                    out.append(g)
    except:
        pass

    return out

def subd_from_mesh_best_effort(mesh_obj):
    if mesh_obj is None or (not mesh_obj.IsValid) or mesh_obj.Vertices.Count == 0:
        return None

    subd_obj = None
    try:
        fn = getattr(rg.SubD, "CreateFromMesh", None)
    except:
        fn = None

    if fn is None:
        return None

    for args in ((mesh_obj,), (mesh_obj, True), (mesh_obj, False)):
        try:
            subd_obj = fn(*args)
        except:
            subd_obj = None
        if subd_obj is not None:
            break
    return subd_obj

def smooth_support_sweeps_subd_like(
    sweep_tree,
    abs_tol=1e-3,
    ang_tol_rad=np.pi / 180.0,
    smooth_control=0.5
):
    geos = collect_tree_geometry(sweep_tree)
    breps = [g for g in geos if isinstance(g, rg.Brep)]
    if not breps:
        return None

    union = None
    try:
        union = rg.Brep.CreateBooleanUnion(breps, float(abs_tol))
    except:
        union = None

    work_breps = list(union) if union and len(union) > 0 else list(breps)
    if not work_breps:
        return None

    merged = rg.Mesh()
    mp = rg.MeshingParameters.Smooth
    try:
        mp.MinimumEdgeLength = max(0.0, float(abs_tol))
    except:
        pass

    for b in work_breps:
        parts = None
        try:
            parts = rg.Mesh.CreateFromBrep(b, mp)
        except:
            try:
                parts = rg.Mesh.CreateFromBrep(b)
            except:
                parts = None
        if not parts:
            continue
        for m in parts:
            if m is not None and m.IsValid and m.Vertices.Count > 0:
                merged.Append(m)

    if merged.Vertices.Count == 0:
        if union and len(union) > 0:
            return union[0]
        return None

    try:
        merged.Weld(float(ang_tol_rad))
    except:
        pass
    try:
        merged.UnifyNormals()
    except:
        pass
    try:
        merged.Normals.ComputeNormals()
    except:
        pass

    ctrl = as_float(smooth_control, 0.5)
    if ctrl < 0.0:
        ctrl = 0.0
    if ctrl > 1.0:
        ctrl = 1.0

    # Single user control mapped to iterations and Laplacian factor.
    steps = int(round(2.0 + 12.0 * ctrl))
    fac = 0.15 + 0.55 * ctrl

    for _ in range(steps):
        ok = False
        try:
            ok = bool(merged.Smooth(float(fac), True, True, True, False))
        except:
            try:
                ok = bool(merged.Smooth(float(fac)))
            except:
                ok = False
        if not ok:
            break

    try:
        merged.Normals.ComputeNormals()
    except:
        pass
    try:
        merged.Compact()
    except:
        pass

    subd_obj = subd_from_mesh_best_effort(merged)
    if subd_obj is not None:
        return subd_obj
    return merged

def generate_recursive_support_branches(
    root_ground_pts,
    root_top_pts,
    depth,
    branches_per_node,
    base_length,
    length_reduction,
    branch_start_height,
    extension_length,
    trim_mesh=None,
    trim_tol=1e-3,
    boundary_crv=None,
    boundary_tol=1e-3
):
    if depth <= 0:
        return [], {}

    def local_frame_from_direction(direction):
        d = rg.Vector3d(direction)
        if d.IsZero:
            d = rg.Vector3d(0, 0, 1)
        d.Unitize()

        ref = rg.Vector3d(0, 0, 1)
        if abs(rg.Vector3d.Multiply(d, ref)) > 0.95:
            ref = rg.Vector3d(1, 0, 0)

        x_axis = rg.Vector3d.CrossProduct(d, ref)
        if x_axis.IsZero:
            x_axis = rg.Vector3d(1, 0, 0)
        x_axis.Unitize()

        y_axis = rg.Vector3d.CrossProduct(d, x_axis)
        if y_axis.IsZero:
            y_axis = rg.Vector3d(0, 1, 0)
        y_axis.Unitize()

        return x_axis, y_axis

    root_count = min(len(root_ground_pts), len(root_top_pts))
    level_records = {}
    children_by_parent = {}
    next_seg_id = [0]

    def add_record(level, parent_id, curve, tip_pt, direction):
        seg_id = next_seg_id[0]
        next_seg_id[0] += 1
        rec = {
            "id": seg_id,
            "level": int(level),
            "parent_id": parent_id,
            "curve": curve,
            "tip": tip_pt,
            "dir": rg.Vector3d(direction)
        }
        if level not in level_records:
            level_records[level] = []
        level_records[level].append(rec)
        if parent_id is not None:
            if parent_id not in children_by_parent:
                children_by_parent[parent_id] = []
            children_by_parent[parent_id].append(seg_id)
        return seg_id

    for idx in range(root_count):
        root_ground = root_ground_pts[idx]
        target_pt = root_top_pts[idx]

        trunk_vec = rg.Vector3d(target_pt - root_ground)
        trunk_len = trunk_vec.Length
        if trunk_len > 1e-6:
            trunk_dir = rg.Vector3d(trunk_vec)
            trunk_dir.Unitize()
            start_dist = min(max(float(branch_start_height), 0.0), trunk_len)
            start_pt = root_ground + trunk_dir * start_dist
        else:
            start_pt = root_ground

        base_dir = rg.Vector3d(target_pt - start_pt)
        if base_dir.IsZero:
            base_dir = rg.Vector3d(0, 0, 1)
        else:
            base_dir.Unitize()

        trunk_dist = root_ground.DistanceTo(target_pt)
        first_len = float(base_length) if base_length > 0.0 else (trunk_dist / float(max(1, depth)))
        if first_len <= 1e-6:
            first_len = 1.0

        root_phase = (0.173 * float(start_pt.X) + 0.117 * float(start_pt.Y) + 0.619 * float(idx)) % (2.0 * np.pi)

        def grow(point, direction, level, length, parent_id):
            if level <= 0 or length <= 1e-6:
                return

            x_axis, y_axis = local_frame_from_direction(direction)

            for branch_idx in range(branches_per_node):
                theta = root_phase + (2.0 * np.pi * float(branch_idx)) / float(max(1, branches_per_node))
                theta += 0.45 * float(level)

                lateral = x_axis * float(np.cos(theta)) + y_axis * float(np.sin(theta))
                new_dir = rg.Vector3d(direction) * 0.85
                new_dir += lateral * 0.50
                if new_dir.IsZero:
                    new_dir = rg.Vector3d(direction)
                if new_dir.IsZero:
                    new_dir = rg.Vector3d(0, 0, 1)
                new_dir.Unitize()

                end_pt = point + new_dir * float(length)
                seg_curve = rg.Line(point, end_pt).ToNurbsCurve()
                seg_id = add_record(level, parent_id, seg_curve, end_pt, new_dir)
                if level > 1:
                    grow(end_pt, new_dir, level - 1, length * float(length_reduction), seg_id)

        grow(start_pt, base_dir, depth, first_len, None)

    leaf_extension = float(extension_length)
    if leaf_extension <= 1e-6:
        leaf_extension = 10.0
    max_level = int(depth)

    def apply_boundary_descendant_cull(kept_ids_by_level, curve_by_id):
        if boundary_crv is None:
            return kept_ids_by_level

        outside_ids = set()
        for level in kept_ids_by_level.keys():
            for seg_id in kept_ids_by_level[level]:
                crv = curve_by_id.get(seg_id)
                if crv is None:
                    continue
                if not curve_within_projected_boundary(crv, boundary_crv, tol=boundary_tol, sample_count=7):
                    outside_ids.add(seg_id)

        to_remove = set(outside_ids)
        queue = list(outside_ids)
        while queue:
            parent_id = queue.pop()
            for child_id in children_by_parent.get(parent_id, []):
                if child_id in curve_by_id and child_id not in to_remove:
                    to_remove.add(child_id)
                    queue.append(child_id)

        if not to_remove:
            return kept_ids_by_level

        filtered = {}
        for level in kept_ids_by_level.keys():
            kept = set([sid for sid in kept_ids_by_level[level] if sid not in to_remove])
            filtered[level] = kept
        return filtered

    if trim_mesh is None:
        kept_ids_by_level = {}
        curve_by_id = {}
        for level in range(1, max_level + 1):
            kept_ids = set()
            for rec in level_records.get(level, []):
                base_curve = rec["curve"]
                if level != 1:
                    candidate_curve = base_curve
                else:
                    p0 = base_curve.PointAtStart
                    ext_dir = rg.Vector3d(rec["dir"])
                    if ext_dir.IsZero:
                        ext_dir = rg.Vector3d(base_curve.PointAtEnd - p0)
                    if ext_dir.IsZero:
                        continue
                    ext_dir.Unitize()
                    tip = rec["tip"] + ext_dir * leaf_extension
                    if p0.DistanceTo(tip) <= 1e-6:
                        continue
                    candidate_curve = rg.Line(p0, tip).ToNurbsCurve()

                curve_by_id[rec["id"]] = candidate_curve
                kept_ids.add(rec["id"])
            kept_ids_by_level[level] = kept_ids

        kept_ids_by_level = apply_boundary_descendant_cull(kept_ids_by_level, curve_by_id)

        level_curves = {}
        for level in sorted(kept_ids_by_level.keys()):
            curves = [curve_by_id[sid] for sid in kept_ids_by_level[level] if sid in curve_by_id]
            deduped_level = dedupe_line_curves(curves)
            if deduped_level:
                level_curves[level] = deduped_level

        flat = []
        for level in sorted(level_curves.keys()):
            flat.extend(level_curves[level])
        return dedupe_line_curves(flat), level_curves

    kept_ids_by_level = {}
    curve_by_id = {}

    for level in range(1, max_level + 1):
        kept_ids = set()
        for rec in level_records.get(level, []):
            base_curve = rec["curve"]
            p0 = base_curve.PointAtStart
            tip_pt = rec["tip"]
            ext_dir = rg.Vector3d(rec["dir"])
            if ext_dir.IsZero:
                ext_dir = rg.Vector3d(base_curve.PointAtEnd - p0)
            if ext_dir.IsZero:
                continue
            ext_dir.Unitize()

            if level == 1:
                candidate_tip = tip_pt + ext_dir * leaf_extension
                if p0.DistanceTo(candidate_tip) <= 1e-6:
                    continue
                candidate_curve = rg.Line(p0, candidate_tip).ToNurbsCurve()
                cull_if_miss = True
            else:
                child_ids = children_by_parent.get(rec["id"], [])
                lower_kept = kept_ids_by_level.get(level - 1, set())
                has_kept_child = any(cid in lower_kept for cid in child_ids)
                if has_kept_child:
                    candidate_curve = base_curve
                    cull_if_miss = False
                else:
                    level_extension = leaf_extension * (2.0 ** float(level - 1))
                    candidate_tip = tip_pt + ext_dir * level_extension
                    if p0.DistanceTo(candidate_tip) <= 1e-6:
                        continue
                    candidate_curve = rg.Line(p0, candidate_tip).ToNurbsCurve()
                    cull_if_miss = True

            kept_piece = trim_branches_to_mesh(
                [candidate_curve], trim_mesh, tol=trim_tol, cull_non_intersecting=cull_if_miss
            )
            if kept_piece:
                curve_by_id[rec["id"]] = kept_piece[0]
                kept_ids.add(rec["id"])

        kept_ids_by_level[level] = kept_ids

    kept_ids_by_level = apply_boundary_descendant_cull(kept_ids_by_level, curve_by_id)
    kept_level_curves = {}
    for level in sorted(kept_ids_by_level.keys()):
        curves = [curve_by_id[sid] for sid in kept_ids_by_level[level] if sid in curve_by_id]
        deduped_level = dedupe_line_curves(curves)
        if deduped_level:
            kept_level_curves[level] = deduped_level

    flat = []
    for level in sorted(kept_level_curves.keys()):
        flat.extend(kept_level_curves[level])
    return dedupe_line_curves(flat), kept_level_curves

# ---------------------------------------------------------------------------
# INPUT NORMALIZATION
# ---------------------------------------------------------------------------
U = as_int(U, 30, min_value=1)
V = as_int(V, 15, min_value=1)
amp = as_float(amp, 5.0)
freq_u = as_float(freq_u, 1.0)
freq_v = as_float(freq_v, 1.0)
heightmap_type = as_int(heightmap_type, 0, min_value=0)
seed = as_int(seed, 1)
tessellation_type = as_int(globals().get("tessellation_type", 0), 0, min_value=0)
if tessellation_type not in (0, 1):
    tessellation_type = 0
rec_depth = as_int(globals().get("rec_depth", 3), 3, min_value=0)
n_branches = as_int(globals().get("n_branches", 2), 2, min_value=1)
br_length = as_float(globals().get("br_length", 0.0), 0.0, min_value=0.0)
len_reduct = as_float(globals().get("len_reduct", 0.7), 0.7)
if len_reduct <= 0.0:
    len_reduct = 0.7
if len_reduct >= 1.0:
    len_reduct = 0.95
branch_start_height = as_float(globals().get("branch_start_height", 0.0), 0.0, min_value=0.0)
extension_length = as_float(globals().get("extension_length", 10.0), 10.0, min_value=0.0)
main_stem_diameter = as_float(globals().get("main_stem_diameter", 1.0), 1.0, min_value=0.0)
smooth_control = as_float(globals().get("smooth_control", 0.5), 0.5)
if smooth_control < 0.0:
    smooth_control = 0.0
if smooth_control > 1.0:
    smooth_control = 1.0
max_branch_roots = as_int(globals().get("max_branch_roots", 8), 8, min_value=1)

srf_obj = coerce_face_or_surface(srf)
pts_grid = []
bad_count = 0
projected_boundary_crv = None

if srf_obj is not None:
    du = srf_obj.Domain(0); dv = srf_obj.Domain(1)
    du0, du1 = du.T0, du.T1
    dv0, dv1 = dv.T0, dv.T1

    Ug, Vg, H = generate_heightmap(du0, du1, dv0, dv1, U, V, amp, freq_u, freq_v, heightmap_type, seed)
    H_out = H.tolist()

    # Sample displaced points and store them in list/tree form.
    pts_grid = [[None]*(V+1) for _ in range(U+1)]
    bad_count = 0

    for i in range(U + 1):
        path = GH_Path(i)
        for j in range(V + 1):
            u = float(Ug[i, j]); v = float(Vg[i, j])
            pt, n = eval_point_normal(srf_obj, u, v)
            p = pt + n * float(H[i, j])
            p = rg.Point3d(float(p.X), float(p.Y), float(p.Z))
            pts_grid[i][j] = p
            canopy_pts_tree.Add(p, path)
            if not is_finite_point(p):
                bad_count += 1

    # Keep surface degree within valid limits for the current grid size.
    deg_u = 3 if (U + 1) >= 4 else max(1, (U + 1) - 1)
    deg_v = 3 if (V + 1) >= 4 else max(1, (V + 1) - 1)

    srf_A, Pts_A, srf_B, Pts_B = build_surface_candidates(
        pts_grid, U + 1, V + 1, deg_u, deg_v
    )

    # Prefer direct NURBS reconstruction; fall back to loft if needed.
    if srf_A and srf_A.IsValid:
        canopy_srf = srf_A
        canopy_pts_flat = Pts_A
    elif srf_B and srf_B.IsValid:
        canopy_srf = srf_B
        canopy_pts_flat = Pts_B
    else:
        loft_A = loft_surface_from_grid(pts_grid, U + 1, V + 1, along_u=True)
        loft_B = loft_surface_from_grid(pts_grid, U + 1, V + 1, along_u=False)

        if loft_A and loft_A.IsValid:
            surf_from_loft_A = first_face_surface(loft_A)
            canopy_srf = surf_from_loft_A if surf_from_loft_A else loft_A
        elif loft_B and loft_B.IsValid:
            surf_from_loft_B = first_face_surface(loft_B)
            canopy_srf = surf_from_loft_B if surf_from_loft_B else loft_B
        else:
            canopy_srf = None

        canopy_pts_flat = Pts_A

    if bad_count == 0:
        projected_boundary_crv = build_projected_boundary_curve_from_grid(pts_grid)

# ---------------------------------------------------------------------------
# ROOT POINTS (FROM HEIGHTMAP MINIMA)
# ---------------------------------------------------------------------------
if pts_grid and bad_count == 0:
    minima = heightmap_local_minima_indices(H)
    for i, j, _ in minima:
        p_top = pts_grid[i][j]
        p_ground = rg.Point3d(p_top.X, p_top.Y, 0.0)
        root_points.append(p_top)
        root_points_ground.append(p_ground)
        root_trunks.append(rg.Line(p_ground, p_top).ToNurbsCurve())

# ---------------------------------------------------------------------------
# TESSELLATION
# ---------------------------------------------------------------------------
panels = []
mesh = rg.Mesh()

if srf_obj is not None and bad_count == 0:
    # Vertex index convention: i*(V+1) + j.
    rows = U + 1
    cols = V + 1

    # Add mesh vertices.
    for i in range(rows):
        for j in range(cols):
            mesh.Vertices.Add(pts_grid[i][j])

    # Build panel curves and corresponding mesh faces cell by cell.
    for i in range(rows - 1):
        for j in range(cols - 1):
            A = pts_grid[i][j]
            B = pts_grid[i + 1][j]
            C = pts_grid[i + 1][j + 1]
            D = pts_grid[i][j + 1]

            # Mesh indices for this cell.
            a = i * cols + j
            b = a + cols
            c = b + 1
            d = a + 1

            if tessellation_type == 0:
                quad_pl = rg.Polyline([A, B, C, D, A])
                panels.append(quad_pl.ToNurbsCurve())
                mesh.Faces.AddFace(a, b, c, d)
            else:
                tri1 = rg.Polyline([A, B, C, A])
                tri2 = rg.Polyline([A, C, D, A])
                panels.append(tri1.ToNurbsCurve())
                panels.append(tri2.ToNurbsCurve())
                mesh.Faces.AddFace(a, b, c)
                mesh.Faces.AddFace(a, c, d)

    mesh.Normals.ComputeNormals()
    mesh.Compact()
else:
    # Skip tessellation when point sampling is invalid.
    panels = []
    mesh = None

# ---------------------------------------------------------------------------
# RECURSIVE SUPPORT BRANCHES
# ---------------------------------------------------------------------------
support_root_count = min(len(root_points), len(root_points_ground), max_branch_roots)
support_cull_tol = 1e-3
try:
    doc = Rhino.RhinoDoc.ActiveDoc
    if doc is not None:
        support_cull_tol = max(support_cull_tol, float(doc.ModelAbsoluteTolerance))
except:
    pass

if support_root_count > 0:
    support_root_stems, support_root_ground_pts, support_root_top_pts = build_root_stems_to_branch_start(
        root_points_ground[:support_root_count],
        root_points[:support_root_count],
        branch_start_height,
        boundary_crv=projected_boundary_crv,
        tol=support_cull_tol
    )
else:
    support_root_stems = []
    support_root_ground_pts = []
    support_root_top_pts = []

if support_root_ground_pts and rec_depth > 0:
    support_branches, support_levels = generate_recursive_support_branches(
        support_root_ground_pts,
        support_root_top_pts,
        rec_depth,
        n_branches,
        br_length,
        len_reduct,
        branch_start_height,
        extension_length,
        trim_mesh=mesh,
        trim_tol=support_cull_tol,
        boundary_crv=projected_boundary_crv,
        boundary_tol=support_cull_tol
    )
else:
    support_branches = []
    support_levels = {}

supports = level_map_to_tree(
    support_levels,
    first_level_curves=support_root_stems,
    reverse_recursive=True
)
support_sweeps_tree = sweep_supports_to_tree(
    support_levels,
    first_level_curves=support_root_stems,
    reverse_recursive=True,
    first_diameter=main_stem_diameter,
    last_diameter=0.2,
    abs_tol=support_cull_tol,
    ang_tol_rad=np.pi / 180.0
)
support_sweeps = smooth_support_sweeps_subd_like(
    support_sweeps_tree,
    abs_tol=support_cull_tol,
    ang_tol_rad=np.pi / 180.0,
    smooth_control=smooth_control
)
support_smooth = support_sweeps

# ---------------------------------------------------------------------------
# FINAL OUTPUTS
# ---------------------------------------------------------------------------
out_points_flat = canopy_pts_flat
out_points_tree = canopy_pts_tree
out_heightmap = H_out
out_root_points = root_points
out_root_points_ground = root_points_ground
out_root_trunks = root_trunks
out_support_branches = support_branches
out_supports = supports
out_support_sweeps = support_sweeps
out_support_smooth = support_smooth
out_panels = panels
out_mesh = mesh
# ---------- end py3_4 ----------
pt = Point(py3_2.points)  # disabled
pt_2 = Point(py3.points)
pt_3 = Point(py3_3.lowest_pts)
pt_4 = Point(py3_3.points)
geo = Geometry(py3_3.surface_points)
geo_2 = Geometry(py3_3.mesh_lines)
geo_3 = Geometry(py3_3.surface)
panel = Panel(py3.out)
item = ListItem(List=geo, Index=Slider(5, range=0..10), Wrap=True)
srf_2 = Surface(<surface referenced from the Rhino model>)
geo_4 = Geometry(py3_4.out_root_trunks)
geo_5 = Geometry(py3_4.out_supports)
geo_6 = Geometry(py3_4.out_support_sweeps)
preview = CustomPreview(Geometry=py3_4.out_mesh, Material=ColourSwatch(SwatchColor=RGB(235, 235, 235)))
preview_2 = CustomPreview(Geometry=py3_4.out_panels, Material=ColourSwatch(SwatchColor=RGB(51, 51, 51)))
preview_3 = CustomPreview(Geometry=geo_6, Material=ColourSwatch(SwatchColor=RGB(56, 56, 56)))
preview_4 = CustomPreview(Geometry=srf_2, Material=ColourSwatch(SwatchColor=RGB(235, 235, 235)))
