# Grasshopper definition A4.gh (Grasshopper 1.0.8)

srf = Surface(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)
area = Area(Geometry=srf)  # -> Area, Centroid
scale = Scale(Geometry=srf, Center=area.Centroid, Factor=0.5)  # -> Geometry, Transform
Z = UnitZ(Factor=Slider(20, range=0..100))
number_slider = Slider(1, range=0..1)
number_slider_2 = Slider(1, range=0..1)
number_slider_3 = Slider(15, range=0..1000)
number_slider_4 = Slider(30, range=0..1000)
number_slider_5 = Slider(10, range=0..100)
neg = Negative(Value=Z)
move = Move(Geometry=scale.Geometry, Motion=neg)  # -> Geometry, Transform
py3 = Python3Script(
    base_surface=move.Geometry,
    divU=number_slider_3,
    divV=number_slider_3,
    point_divU=number_slider_4,
    point_divV=number_slider_4,
    frequency=Slider(4, range=0..10),
    phase=Slider(5, range=0..10),
    amplitude=Slider(3, range=0..10),
    lift=Slider(0, range=0..1),
    heightmap_type=Slider(1, range=0..100),
    seed=number_slider_5,
    terrain_complexity=Slider(0.21, range=0..1),
    terrain_steepness=Slider(0.7, range=0..1))  # -> out_surface, out_points, srf_id
# ---------- py3: Python ----------
#r: numpy
import Rhino.Geometry as rg
import rhinoscriptsyntax as rs
import numpy as np
import random
import math

# ---------------------------------------------------------------------------
# INPUT CONTRACT (Grasshopper)
# ---------------------------------------------------------------------------
# Required inputs:
# - base_surface : Surface/BrepFace/Brep (if Brep, first face is used)
# - divU         : int, U subdivisions used to rebuild out_surface
# - divV         : int, V subdivisions used to rebuild out_surface
# - frequency    : float, wave frequency for the displacement field
# - phase        : float, wave phase shift
# - amplitude    : float, displacement amplitude along surface normal
# - lift         : float, global Z offset after displacement
#
# Optional inputs:
# - seed            : int, deterministic seed (mainly for noise mode)
# - heightmap_type  : int (0 = wave+bump, 1 = radial falloff + deterministic noise)
#
# - point_divU      : int, optional output-point U subdivisions (independent of divU)
# - point_divV      : int, optional output-point V subdivisions (independent of divV)
#   Aliases supported: seed_divU/seed_divV, out_divU/out_divV
#
# - terrain_complexity : float in [0,1]. Higher = more detail + more macro variation
# - terrain_steepness  : float in [0,1]. Higher = sharper ridges + steeper transitions
#
# Outputs:
# - out_surface : generated displaced surface (NurbsSurface or Brep fallback)
# - out_points  : flattened displaced Point3d list (uniform grid by point_divU/point_divV)
# - srf_id      : compatibility output (always None in this RhinoCommon workflow)
# ---------------------------------------------------------------------------


def coerce_face_or_surface(geo):
    g = getattr(geo, "Geometry", geo)
    try:
        import System
        if isinstance(g, System.Guid):
            g = rs.coercesurface(g) or rs.coercebrep(g)
    except:
        pass
    if isinstance(g, rg.Brep) and g.Faces.Count > 0:
        return g.Faces[0]
    return g


def as_int(value, default, min_value=None):
    try:
        out = int(value)
    except:
        out = int(default)
    if min_value is not None and out < min_value:
        out = int(min_value)
    return out


def as_float(value, default, min_value=None):
    try:
        out = float(value)
    except:
        out = float(default)
    if min_value is not None and out < min_value:
        out = float(min_value)
    return out

def clamp01(x):
    if x < 0.0:
        return 0.0
    if x > 1.0:
        return 1.0
    return x


def eval_point_normal(srf_obj, u, v):
    pt = srf_obj.PointAt(u, v)
    n = srf_obj.NormalAt(u, v)
    if (not n.IsValid) or n.IsZero:
        n = rg.Vector3d(0, 0, 1)
    else:
        n.Unitize()
    return pt, n


def deterministic_noise(un, vn, seed_val):
    # Deterministic pseudo-noise in [-1, 1], independent of grid resolution.
    n = np.sin((12.9898 * un) + (78.233 * vn) + (37.719 * float(seed_val))) * 43758.5453
    frac = n - np.floor(n)
    return (frac * 2.0) - 1.0

def value_noise_2d(un, vn, cells_u, cells_v, seed_val):
    """
    Smooth value noise sampled from a random lattice with bilinear interpolation.
    Output range: [0, 1].
    """
    cu = max(1, int(cells_u))
    cv = max(1, int(cells_v))
    rng = np.random.RandomState(int(seed_val))
    lattice = rng.rand(cu + 1, cv + 1)

    x = np.minimum(un * float(cu), float(cu) - 1e-9)
    y = np.minimum(vn * float(cv), float(cv) - 1e-9)

    xi = np.floor(x).astype(np.int32)
    yi = np.floor(y).astype(np.int32)
    xf = x - xi
    yf = y - yi

    # Smoothstep interpolation for gentler slope transitions.
    sx = xf * xf * (3.0 - 2.0 * xf)
    sy = yf * yf * (3.0 - 2.0 * yf)

    xi1 = xi + 1
    yi1 = yi + 1

    v00 = lattice[xi, yi]
    v10 = lattice[xi1, yi]
    v01 = lattice[xi, yi1]
    v11 = lattice[xi1, yi1]

    a = v00 + (v10 - v00) * sx
    b = v01 + (v11 - v01) * sx
    return a + (b - a) * sy

def fbm_noise_2d(un, vn, base_cells, octaves, roughness, lacunarity, seed_val):
    """
    Fractal Brownian motion noise from value-noise octaves.
    Output range: approximately [0, 1].
    """
    octv = max(1, int(octaves))
    amp = 1.0
    sum_amp = 0.0
    out = np.zeros_like(un, dtype=float)
    cells = max(1.0, float(base_cells))

    for o in range(octv):
        n = value_noise_2d(un, vn, int(round(cells)), int(round(cells)), int(seed_val) + (o * 1013))
        out += amp * n
        sum_amp += amp
        amp *= float(roughness)
        cells *= float(lacunarity)

    if sum_amp > 1e-12:
        out /= sum_amp
    return out

def random_terrain_field(un, vn, amp, freq, seed_val, opts):
    """
    Random terrain with mixed low/high slope zones:
    - multi-octave smooth noise
    - optional ridged mixing
    - macro hill/valley blobs
    """
    octaves = int(opts.get("octaves", 5))
    roughness = float(opts.get("roughness", 0.55))
    lacunarity = float(opts.get("lacunarity", 2.0))
    ridge_mix = clamp01(float(opts.get("ridge_mix", 0.35)))
    peak_count = max(0, int(opts.get("peak_count", 6)))
    peak_strength = max(0.0, float(opts.get("peak_strength", 0.6)))
    contrast = max(0.1, float(opts.get("contrast", 1.5)))

    base_cells = max(1.0, 2.0 * max(0.25, float(freq)))

    fbm = fbm_noise_2d(un, vn, base_cells, octaves, roughness, lacunarity, seed_val)
    base = (fbm * 2.0) - 1.0

    # Ridged variant emphasizes steeper transitions.
    ridged01 = 1.0 - np.abs(base)
    ridged = (ridged01 * 2.0) - 1.0
    terrain = ((1.0 - ridge_mix) * base) + (ridge_mix * ridged)

    # Add macro hills/valleys to create broad low/high slope regions.
    if peak_count > 0 and peak_strength > 1e-12:
        rng = np.random.RandomState(int(seed_val) + 7919)
        macro = np.zeros_like(un, dtype=float)
        for _ in range(peak_count):
            cx = rng.rand()
            cy = rng.rand()
            sigma = rng.uniform(0.08, 0.28)
            h = rng.uniform(-1.0, 1.0)
            d2 = ((un - cx) ** 2 + (vn - cy) ** 2) / max(1e-9, sigma * sigma)
            macro += h * np.exp(-0.5 * d2)
        m = np.max(np.abs(macro))
        if m > 1e-12:
            macro /= m
        terrain = ((1.0 - peak_strength) * terrain) + (peak_strength * macro)

    # Contrast boost for clearer steep/flat distinctions.
    terrain = np.tanh(contrast * terrain)
    return float(amp) * terrain


def terrain_options_from_controls(complexity, steepness):
    """
    Map two user-friendly controls to full random-terrain parameters.
    """
    c = clamp01(float(complexity))
    s = clamp01(float(steepness))

    octaves = int(round(3.0 + 5.0 * c))          # 3..8
    roughness = max(0.25, 0.72 - 0.27 * c)       # ~0.72..0.45
    lacunarity = 1.5 + 1.0 * c                   # 1.5..2.5
    ridge_mix = clamp01(0.10 + 0.80 * s)         # 0.1..0.9
    peak_count = int(round(2.0 + 8.0 * c))       # 2..10
    peak_strength = clamp01(0.20 + 0.65 * c)     # 0.2..0.85
    contrast = 0.9 + 2.2 * s                     # 0.9..3.1

    return {
        "octaves": octaves,
        "roughness": roughness,
        "lacunarity": lacunarity,
        "ridge_mix": ridge_mix,
        "peak_count": peak_count,
        "peak_strength": peak_strength,
        "contrast": contrast
    }


def evaluate_height_field(un, vn, amp, freq, phs, heightmap_type, seed_val, terrain_opts=None):
    if int(heightmap_type) == 0:
        wave = np.sin((2.0 * math.pi * freq * (un + vn)) + phs)
        dist = np.sqrt((un - 0.5) ** 2 + (vn - 0.5) ** 2)
        bump = np.exp(-5.0 * dist ** 2)
        return amp * (0.6 * wave + 0.4 * bump)

    # Richer random terrain mode (type 1).
    return random_terrain_field(un, vn, amp, freq, seed_val, terrain_opts or {})


def sample_displaced_grid(
    srf_obj,
    dom_u,
    dom_v,
    u_div,
    v_div,
    amp,
    freq,
    phs,
    heightmap_type,
    lift_val,
    seed_val,
    terrain_opts=None
):
    # Parameter-space sampling.
    u_vals = np.linspace(dom_u.T0, dom_u.T1, u_div + 1)
    v_vals = np.linspace(dom_v.T0, dom_v.T1, v_div + 1)
    Ug, Vg = np.meshgrid(u_vals, v_vals, indexing="ij")

    # Normalized UV for displacement field evaluation.
    un = np.linspace(0.0, 1.0, u_div + 1)
    vn = np.linspace(0.0, 1.0, v_div + 1)
    Un, Vn = np.meshgrid(un, vn, indexing="ij")

    H = evaluate_height_field(Un, Vn, amp, freq, phs, heightmap_type, seed_val, terrain_opts)

    pts_grid = [[None] * (v_div + 1) for _ in range(u_div + 1)]
    pts_flat = []

    for i in range(u_div + 1):
        for j in range(v_div + 1):
            pt, n = eval_point_normal(srf_obj, float(Ug[i, j]), float(Vg[i, j]))
            p = pt + n * float(H[i, j])
            p3 = rg.Point3d(float(p.X), float(p.Y), float(p.Z + lift_val))
            pts_grid[i][j] = p3
            pts_flat.append(p3)

    return pts_grid, pts_flat


def build_surface_candidates(pts_grid, u_count, v_count, deg_u, deg_v):
    pts_a = [pts_grid[i][j] for i in range(u_count) for j in range(v_count)]
    pts_b = [pts_grid[i][j] for j in range(v_count) for i in range(u_count)]

    srf_a = rg.NurbsSurface.CreateThroughPoints(pts_a, u_count, v_count, deg_u, deg_v, False, False)
    srf_b = rg.NurbsSurface.CreateThroughPoints(pts_b, u_count, v_count, deg_u, deg_v, False, False)
    return srf_a, pts_a, srf_b, pts_b


def loft_surface_from_grid(pts_grid, u_count, v_count, along_u=True):
    curves = []
    if along_u:
        for i in range(u_count):
            row_pts = [pts_grid[i][j] for j in range(v_count)]
            pl = rg.Polyline(row_pts)
            if pl.IsValid and pl.Count >= 2:
                curves.append(pl.ToNurbsCurve())
    else:
        for j in range(v_count):
            col_pts = [pts_grid[i][j] for i in range(u_count)]
            pl = rg.Polyline(col_pts)
            if pl.IsValid and pl.Count >= 2:
                curves.append(pl.ToNurbsCurve())

    if len(curves) < 2:
        return None

    breps = rg.Brep.CreateFromLoft(
        curves,
        rg.Point3d.Unset,
        rg.Point3d.Unset,
        rg.LoftType.Normal,
        False
    )
    if breps and len(breps) > 0 and breps[0] and breps[0].IsValid:
        return breps[0]
    return None


def first_face_surface(brep_obj):
    if brep_obj and isinstance(brep_obj, rg.Brep) and brep_obj.Faces.Count > 0:
        return brep_obj.Faces[0].ToNurbsSurface()
    return None


# ---------------------------------------------------------------------------
# INPUT NORMALIZATION
# ---------------------------------------------------------------------------
IN_base_surface = globals().get("base_surface", None)
IN_seed = globals().get("seed", None)
IN_divU = globals().get("divU", 24)
IN_divV = globals().get("divV", 24)
IN_frequency = globals().get("frequency", 1.0)
IN_phase = globals().get("phase", 0.0)
IN_amplitude = globals().get("amplitude", 1.0)
IN_lift = globals().get("lift", 0.0)
IN_heightmap_type = globals().get("heightmap_type", 0)
IN_terrain_complexity = globals().get("terrain_complexity", 0.6)
IN_terrain_steepness = globals().get("terrain_steepness", 0.6)

# Independent output-point density controls.
IN_point_divU = globals().get(
    "point_divU",
    globals().get("seed_divU", globals().get("out_divU", IN_divU))
)
IN_point_divV = globals().get(
    "point_divV",
    globals().get("seed_divV", globals().get("out_divV", IN_divV))
)

U = as_int(IN_divU, 24, min_value=1)
V = as_int(IN_divV, 24, min_value=1)
U_pts = as_int(IN_point_divU, U, min_value=1)
V_pts = as_int(IN_point_divV, V, min_value=1)

freq = as_float(IN_frequency, 1.0)
phs = as_float(IN_phase, 0.0)
amp = as_float(IN_amplitude, 1.0)
lift_val = as_float(IN_lift, 0.0)
heightmap_type = as_int(IN_heightmap_type, 0, min_value=0)
terrain_complexity = clamp01(as_float(IN_terrain_complexity, 0.6))
terrain_steepness = clamp01(as_float(IN_terrain_steepness, 0.6))

seed_i = 0
if IN_seed is not None:
    try:
        seed_i = int(IN_seed)
    except:
        seed_i = 0
random.seed(seed_i)
np.random.seed(seed_i)

terrain_opts = terrain_options_from_controls(terrain_complexity, terrain_steepness)


# ---------------------------------------------------------------------------
# OUTPUTS
# ---------------------------------------------------------------------------
out_surface = None
out_points = []
srf_id = None  # Compatibility placeholder; no document object is created here.


# ---------------------------------------------------------------------------
# MAIN
# ---------------------------------------------------------------------------
srf_obj = coerce_face_or_surface(IN_base_surface)

if srf_obj is not None and isinstance(srf_obj, (rg.Surface, rg.BrepFace)):
    dom_u = srf_obj.Domain(0)
    dom_v = srf_obj.Domain(1)

    # 1) Build displaced grid used to reconstruct the output surface.
    pts_grid_surface, pts_flat_surface = sample_displaced_grid(
        srf_obj,
        dom_u,
        dom_v,
        U,
        V,
        amp,
        freq,
        phs,
        heightmap_type,
        lift_val,
        seed_i,
        terrain_opts
    )

    deg_u = 3 if (U + 1) >= 4 else max(1, U)
    deg_v = 3 if (V + 1) >= 4 else max(1, V)

    srf_a, pts_a, srf_b, pts_b = build_surface_candidates(
        pts_grid_surface, U + 1, V + 1, deg_u, deg_v
    )

    if srf_a and srf_a.IsValid:
        out_surface = srf_a
    elif srf_b and srf_b.IsValid:
        out_surface = srf_b
    else:
        loft_a = loft_surface_from_grid(pts_grid_surface, U + 1, V + 1, along_u=True)
        loft_b = loft_surface_from_grid(pts_grid_surface, U + 1, V + 1, along_u=False)

        if loft_a and loft_a.IsValid:
            out_surface = first_face_surface(loft_a) or loft_a
        elif loft_b and loft_b.IsValid:
            out_surface = first_face_surface(loft_b) or loft_b

    # 2) Build output points with independent density (for agent seeding/control).
    if (U_pts == U) and (V_pts == V):
        out_points = pts_flat_surface
    else:
        _, pts_flat_dense = sample_displaced_grid(
            srf_obj,
            dom_u,
            dom_v,
            U_pts,
            V_pts,
            amp,
            freq,
            phs,
            heightmap_type,
            lift_val,
            seed_i,
            terrain_opts
        )
        out_points = pts_flat_dense
# ---------- end py3 ----------
srf_2 = Surface(<surface referenced from the Rhino model>)
number_slider_6 = Slider(0.1, range=0..0.1)
number_slider_7 = Slider(2, range=0..10)
pt = Point(py3.out_points)
button = Button()
srf_3 = Surface(py3.out_surface)
agent_builder = Python3Script(
    reset=button,
    base_surface=py3.out_surface,
    seed=number_slider_5,
    max_speed=Slider(0.4, range=0..1),
    seed_points=py3.out_points)  # -> agents; inputs seed_points: list
# ---------- agent_builder: Python ----------
import rhinoscriptsyntax as rs
import random
import numpy as np
import Rhino.Geometry as rg

# ---------------------------------------------------------------------------
# INPUT CONTRACT (Grasshopper)
# ---------------------------------------------------------------------------
# Inputs:
# - reset        : bool. Rebuilds agents when True (edge/hold behavior is handled upstream).
# - base_surface : Surface/BrepFace/Brep. If Brep, first face is used.
# - seed         : int (optional). Random/NumPy seed for repeatable initialization noise.
# - max_speed    : float. Base step size for each agent.
# - seed_points  : list[Point3d]. Initial points projected to the surface as agent starts.
#
# Outputs:
# - agents       : list[Agent] for downstream simulation.
# Notes:
# - Debug values are still stored on the component instance as:
#   self.dbg and self.seed_preview
# - If seed_points is empty, a fallback UV grid is generated internally.
# - Agent/seed tuning values are currently INTERNAL ONLY (constants below).
# ---------------------------------------------------------------------------

# ---------------------------------------------------------------------------
# INTERNAL TUNING (edit here, no GH input required)
# ---------------------------------------------------------------------------
FALLBACK_DIV_U = 8
FALLBACK_DIV_V = 8

AGENT_FREEDOM = 0.75
AGENT_BASE_SPACING = 1.25
AGENT_CURV_GAIN = 0.45
AGENT_SLOPE_GAIN = 0.95
AGENT_SEP_GAIN = 1.85
AGENT_COH_GAIN = 0.72
AGENT_COH_RADIUS_MULT = 2.0
AGENT_MOMENTUM = 0.6
AGENT_CURV_SPEED_K = 1.2
AGENT_SLOPE_SPEED_K = 0.9
AGENT_SLOPE_SPACING_K = 0.8
AGENT_CURV_FOLLOW_K = 1.5
AGENT_EPS_FRAC = 0.01
# Neighborhood mean-slope modulation for group behavior:
# steeper local neighborhoods -> stronger separation and slightly weaker cohesion.
AGENT_GROUP_SLOPE_GAIN = 0.55
# Peer slope-follow rule:
# if neighbor slope is higher than self, self is gently attracted toward that neighbor.
AGENT_SLOPE_PEER_GAIN = 0.45
AGENT_SLOPE_DIFF_MIN = 0.04
# Reference-like stability controls.
AGENT_CURV_USE_MAX = True
AGENT_CURV_SCALE = 0.08
AGENT_CURV_DAMP = 0.60
AGENT_SLOPE_DAMP = 0.25
AGENT_HARDCORE_RATIO = 0.35
AGENT_HARDCORE_BOOST = 2.0
AGENT_SEP_VEC_CAP = 3.0
# Structural constraints (quad-preserving behavior).
STRUCT_ENABLE = True
STRUCT_GRID_U = None         # set int to force grid U count; None = infer
STRUCT_GRID_V = None         # set int to force grid V count; None = infer
STRUCT_USE_DIAGONALS = False # True adds diagonal structural springs
STRUCT_SPRING_GAIN = 0.65    # spring toward rest edge lengths
STRUCT_MIN_DIST_RATIO = 0.70 # minimum allowed fraction of structural rest length
STRUCT_MIN_DIST_GAIN = 1.45  # push strength when structural edges collapse

# Seed shaping. Set SEED_INIT_AGENT_COUNT to None to use all available seeds.
SEED_INIT_AGENT_COUNT = None
SEED_SLOPE_BIAS = 0.0
SEED_SLOPE_POWER = 2.0

# ---------------------------------------------------------------------------
# Utility helpers
# ---------------------------------------------------------------------------
def seed_everything(seed):
    if seed is None: return
    try: s = int(seed)
    except: return
    random.seed(s)
    np.random.seed(s)

def coerce_surface_face(base_surface):
    srf_geo = getattr(base_surface, "Geometry", base_surface)
    try:
        import System
        if isinstance(srf_geo, System.Guid):
            srf_geo = rs.coercesurface(srf_geo)
    except:
        pass
    if isinstance(srf_geo, rg.Brep) and srf_geo.Faces.Count > 0:
        srf_geo = srf_geo.Faces[0]
    return srf_geo

def iter_any(obj):
    if obj is None:
        return []
    try:
        return [x for x in obj]
    except:
        return [obj]

def to_point3d(pt):
    p = getattr(pt, "Location", pt)
    try:
        c = rs.coerce3dpoint(p)
        return rg.Point3d(c[0], c[1], c[2])
    except:
        pass
    try:
        return rg.Point3d(p.X, p.Y, p.Z)
    except:
        return None

def key3(p, prec=6):
    return (round(p.X, prec), round(p.Y, prec), round(p.Z, prec))

def key2(u, v, prec=6):
    return (round(u, prec), round(v, prec))

def as_int(value, default, min_value=None):
    try:
        out = int(value)
    except:
        out = int(default)
    if min_value is not None and out < min_value:
        out = int(min_value)
    return out

def as_float(value, default, min_value=None):
    try:
        out = float(value)
    except:
        out = float(default)
    if min_value is not None and out < min_value:
        out = float(min_value)
    return out

def clamp01(x):
    if x < 0.0:
        return 0.0
    if x > 1.0:
        return 1.0
    return x

def clamp_param(t, dom):
    if t < dom.T0: return dom.T0
    if t > dom.T1: return dom.T1
    return t

def project_to_tangent(v, n):
    # v_tan = v - n*(v·n)
    return v - n * rg.Vector3d.Multiply(v, n)


def slope_magnitude_from_normal(n):
    if n is None or n.IsZero:
        return 0.0
    nn = rg.Vector3d(n)
    nn.Unitize()
    z = rg.Vector3d(0, 0, 1)
    dz = abs(rg.Vector3d.Multiply(nn, z))
    return 1.0 - max(0.0, min(1.0, dz))


def select_seed_points(surface, pts3, target_count, slope_bias, slope_power, seed_val):
    """
    Select initial seed points, optionally biased toward high-slope regions.
    Returns selected points and a debug tuple: (candidate_count, selected_count).
    """
    if not pts3:
        return [], (0, 0)

    n = len(pts3)
    target = as_int(target_count, n, min_value=1)
    b = clamp01(as_float(slope_bias, 0.0))
    pwr = as_float(slope_power, 2.0, min_value=0.1)

    # Fast path: no bias and no resampling requested.
    if b <= 1e-12 and target == n:
        return list(pts3), (n, n)

    candidates = []
    weights = []

    for p3 in pts3:
        ok, u, v = surface.ClosestPoint(p3)
        if not ok:
            continue
        nrm = surface.NormalAt(u, v)
        slope_mag = slope_magnitude_from_normal(nrm)
        w = (1.0 - b) + (b * (slope_mag ** pwr))
        if w <= 1e-12:
            w = 1e-12
        candidates.append(p3)
        weights.append(w)

    m = len(candidates)
    if m == 0:
        return [], (0, 0)

    w = np.array(weights, dtype=float)
    w_sum = float(np.sum(w))
    if w_sum <= 1e-12:
        w[:] = 1.0 / float(m)
    else:
        w /= w_sum

    replace = bool(target > m)
    rng = np.random.RandomState(int(seed_val) if seed_val is not None else 0)
    try:
        idx = rng.choice(m, size=target, replace=replace, p=w)
    except:
        idx = rng.choice(m, size=target, replace=replace)

    selected = [candidates[int(i)] for i in idx]
    return selected, (m, len(selected))


def infer_grid_dims(n, aspect_uv):
    """
    Infer (u_count, v_count) from total point count using factor pairs.
    Chooses pair whose u/v ratio best matches surface UV aspect.
    """
    n = as_int(n, 0, min_value=0)
    if n < 4:
        return None

    candidates = []
    r = int(n ** 0.5)
    for a in range(2, r + 1):
        if n % a != 0:
            continue
        b = n // a
        candidates.append((a, b))
        if a != b:
            candidates.append((b, a))

    if not candidates:
        return None

    target = max(1e-9, float(aspect_uv))
    best = None
    best_err = None
    for u_count, v_count in candidates:
        ratio = float(u_count) / float(v_count)
        err = abs(ratio - target)
        if (best_err is None) or (err < best_err):
            best_err = err
            best = (u_count, v_count)
    return best


def assign_structural_links(agents, surface):
    """
    Build structural neighbor graph (grid edges) and rest edge lengths.
    Assumes current ordering corresponds to row-major UV grid:
      idx = i * v_count + j
    """
    for a in agents:
        a.struct_i = -1
        a.struct_j = -1
        a.struct_neighbors = []
        a.struct_rest_lengths = []

    if (not bool(STRUCT_ENABLE)) or (not agents):
        return {
            "enabled": False,
            "reason": "disabled_or_empty",
            "u_count": 0,
            "v_count": 0,
            "links": 0
        }

    n = len(agents)
    u_count = None
    v_count = None

    if (STRUCT_GRID_U is not None) and (STRUCT_GRID_V is not None):
        u_try = as_int(STRUCT_GRID_U, 0, min_value=2)
        v_try = as_int(STRUCT_GRID_V, 0, min_value=2)
        if (u_try * v_try) == n:
            u_count, v_count = u_try, v_try

    if (u_count is None) or (v_count is None):
        dom_u = surface.Domain(0)
        dom_v = surface.Domain(1)
        du = abs(float(dom_u.T1 - dom_u.T0))
        dv = abs(float(dom_v.T1 - dom_v.T0))
        aspect = (du / dv) if dv > 1e-12 else 1.0
        dims = infer_grid_dims(n, aspect)
        if dims is not None:
            u_count, v_count = dims

    if (u_count is None) or (v_count is None) or (u_count < 2) or (v_count < 2) or ((u_count * v_count) != n):
        return {
            "enabled": False,
            "reason": "dims_not_inferred",
            "u_count": 0,
            "v_count": 0,
            "links": 0
        }

    if bool(STRUCT_USE_DIAGONALS):
        offsets = [(-1, 0), (1, 0), (0, -1), (0, 1), (-1, -1), (-1, 1), (1, -1), (1, 1)]
    else:
        offsets = [(-1, 0), (1, 0), (0, -1), (0, 1)]

    total_links = 0
    for i in range(u_count):
        for j in range(v_count):
            idx = (i * v_count) + j
            a = agents[idx]
            a.struct_i = i
            a.struct_j = j

            neighbors = []
            rest_lengths = []
            p = a.position

            for di, dj in offsets:
                ni = i + di
                nj = j + dj
                if ni < 0 or ni >= u_count or nj < 0 or nj >= v_count:
                    continue
                nidx = (ni * v_count) + nj
                q = agents[nidx].position
                d = float(p.DistanceTo(q))
                if d <= 1e-9:
                    continue
                neighbors.append(int(nidx))
                rest_lengths.append(d)

            a.struct_neighbors = neighbors
            a.struct_rest_lengths = rest_lengths
            total_links += len(neighbors)

    return {
        "enabled": True,
        "reason": "ok",
        "u_count": int(u_count),
        "v_count": int(v_count),
        "links": int(total_links)
    }

# ---------------------------------------------------------------------------
# Agent definition
# ---------------------------------------------------------------------------
class Agent:
    def __init__(self, surface, uv, max_speed, idx=None):
        self.surface = surface
        self.uv = rg.Point2d(uv.X, uv.Y)
        self.uv0 = rg.Point2d(uv.X, uv.Y)
        self.idx = as_int(idx, -1) if idx is not None else -1
        self.struct_i = -1
        self.struct_j = -1
        self.struct_neighbors = []
        self.struct_rest_lengths = []

        self.position = rg.Point3d(surface.PointAt(self.uv.X, self.uv.Y))
        self.velocity = rg.Vector3d(0, 0, 0)

        self.base_speed = float(max_speed)
        self.max_speed = float(max_speed)

        freedom = clamp01(float(AGENT_FREEDOM))
        self.freedom = freedom

        # behavior parameters (tune)
        self.base_spacing = max(1e-6, float(AGENT_BASE_SPACING))
        self.curv_gain = max(0.0, float(AGENT_CURV_GAIN))
        self.slope_gain = max(0.0, float(AGENT_SLOPE_GAIN))
        self.sep_gain = max(0.0, float(AGENT_SEP_GAIN))
        self.coh_gain = max(0.0, float(AGENT_COH_GAIN))
        self.coh_radius_mult = max(1.0, float(AGENT_COH_RADIUS_MULT))
        self.momentum = clamp01(float(AGENT_MOMENTUM))

        # Higher freedom -> weaker home pull + more exploratory jitter.
        self.home_gain = 0.08 * (1.0 - freedom)
        self.noise_gain = 0.002 + (0.012 * freedom)

        # modulation strengths (tune)
        self.curv_speed_k = max(0.0, float(AGENT_CURV_SPEED_K))
        self.slope_speed_k = max(0.0, float(AGENT_SLOPE_SPEED_K))
        self.slope_spacing_k = max(0.0, float(AGENT_SLOPE_SPACING_K))
        self.curv_follow_k = max(0.0, float(AGENT_CURV_FOLLOW_K))

        # numerics
        self.noise = 0.003
        self.eps_frac = max(1e-6, float(AGENT_EPS_FRAC))

        # sensed values
        self.nearest_dist = None
        self.curv_dir = None
        self.curv_mag = 0.0
        self.normal = rg.Vector3d(0, 0, 1)
        self.slope_mag = 0.0
        self.slope_seek = rg.Vector3d(0, 0, 0)

    def sense(self, agents):
        # nearest neighbor distance only (for adaptive spacing)
        self.nearest_dist = None
        for other in agents:
            if other is self:
                continue
            d = self.position.DistanceTo(other.position)
            if self.nearest_dist is None or d < self.nearest_dist:
                self.nearest_dist = d

        # surface signals
        self.curv_dir = None
        self.curv_mag = 0.0
        self.slope_mag = 0.0
        self.slope_seek = rg.Vector3d(0, 0, 0)

        try:
            # normal
            n = self.surface.NormalAt(self.uv.X, self.uv.Y)
            if not n.IsZero:
                n.Unitize()
            self.normal = n

            # slope magnitude relative to world Z
            z = rg.Vector3d(0, 0, 1)
            dz = abs(rg.Vector3d.Multiply(n, z))  # |n·Z|
            self.slope_mag = 1.0 - max(0.0, min(1.0, dz))

            # curvature
            sc = self.surface.CurvatureAt(self.uv.X, self.uv.Y)
            if sc is not None:
                k0 = abs(sc.Kappa(0)); k1 = abs(sc.Kappa(1))
                d0 = sc.Direction(0); d1 = sc.Direction(1)

                # Choose dominant curvature direction (reference-style behavior).
                if bool(AGENT_CURV_USE_MAX):
                    if k0 >= k1:
                        self.curv_dir = d0
                        self.curv_mag = k0
                    else:
                        self.curv_dir = d1
                        self.curv_mag = k1
                else:
                    if k0 <= k1:
                        self.curv_dir = d0
                        self.curv_mag = k0
                    else:
                        self.curv_dir = d1
                        self.curv_mag = k1

                if self.curv_dir is not None and self.curv_dir.Length > 1e-9:
                    self.curv_dir.Unitize()
                else:
                    self.curv_dir = None

            # direction toward higher slope magnitude (finite-difference in UV)
            du = self.surface.Domain(0)
            dv = self.surface.Domain(1)
            eps_u = self.eps_frac * (du.T1 - du.T0)
            eps_v = self.eps_frac * (dv.T1 - dv.T0)

            u0 = self.uv.X
            v0 = self.uv.Y
            p = self.position

            u_p = clamp_param(u0 + eps_u, du)
            u_m = clamp_param(u0 - eps_u, du)
            v_p = clamp_param(v0 + eps_v, dv)
            v_m = clamp_param(v0 - eps_v, dv)

            def slope_mag_at(uq, vq):
                n_q = self.surface.NormalAt(uq, vq)
                if n_q.IsZero:
                    return 0.0
                n_q.Unitize()
                dz_q = abs(rg.Vector3d.Multiply(n_q, z))
                return 1.0 - max(0.0, min(1.0, dz_q))

            m_u_p = slope_mag_at(u_p, v0)
            m_u_m = slope_mag_at(u_m, v0)
            m_v_p = slope_mag_at(u0, v_p)
            m_v_m = slope_mag_at(u0, v_m)

            # Gradient of slope magnitude in UV: move in +grad direction
            grad_u = m_u_p - m_u_m
            grad_v = m_v_p - m_v_m

            p_u = self.surface.PointAt(u_p, v0)
            p_v = self.surface.PointAt(u0, v_p)
            tu = rg.Vector3d(p_u - p)
            tv = rg.Vector3d(p_v - p)

            slope_seek = (tu * grad_u) + (tv * grad_v)
            slope_seek = project_to_tangent(slope_seek, n)
            if slope_seek.Length > 1e-9:
                slope_seek.Unitize()
                self.slope_seek = slope_seek
            else:
                self.slope_seek = rg.Vector3d(0, 0, 0)

        except:
            self.normal = rg.Vector3d(0, 0, 1)
            self.curv_dir = None
            self.curv_mag = 0.0
            self.slope_mag = 0.0
            self.slope_seek = rg.Vector3d(0, 0, 0)

    def decide(self, agents):
        # Surface-conditioned scalars.
        k = max(0.0, float(self.curv_mag))
        s = max(0.0, min(1.0, float(self.slope_mag)))

        # Reference-like speed damping: sharp slowdown on high curvature,
        # then a secondary slowdown on steep slope.
        curv_scale = max(1e-9, float(AGENT_CURV_SCALE))
        curv_norm = k / (k + curv_scale)
        speed_scale = (1.0 - clamp01(float(AGENT_CURV_DAMP) * curv_norm))
        speed_scale *= (1.0 - clamp01(float(AGENT_SLOPE_DAMP) * s))
        speed_scale /= (
            1.0 +
            (0.35 * self.curv_speed_k * curv_norm) +
            (0.25 * self.slope_speed_k * s)
        )
        min_ratio = 0.10 + (0.40 * self.freedom)
        speed_scale = max(min_ratio, min(1.0, speed_scale))
        speed = self.base_speed * speed_scale

        # Neighborhood radii.
        R = self.base_spacing * (1.0 + self.slope_spacing_k * s)
        R = max(1e-6, R)
        R_coh = R * max(1.0, float(self.coh_radius_mult))
        hard_core = max(1e-9, float(AGENT_HARDCORE_RATIO) * R)

        # Direction weights.
        w_curv = self.curv_gain * (1.0 + self.curv_follow_k * k)
        w_slope = self.slope_gain
        w_sep = self.sep_gain
        w_coh = self.coh_gain
        w_peer = max(0.0, float(AGENT_SLOPE_PEER_GAIN))
        w_struct_spring = max(0.0, float(STRUCT_SPRING_GAIN))
        w_struct_min = max(0.0, float(STRUCT_MIN_DIST_GAIN))
        w_home = self.home_gain
        w_noise = self.noise_gain

        # Neighbor accumulation.
        sep = rg.Vector3d(0, 0, 0)
        coh_sum = rg.Vector3d(0, 0, 0)
        coh_count = 0
        peer_slope_vec = rg.Vector3d(0, 0, 0)
        local_slope_sum = s
        local_slope_count = 1
        slope_diff_min = max(0.0, float(AGENT_SLOPE_DIFF_MIN))

        for other in agents:
            if other is self:
                continue
            d = self.position.DistanceTo(other.position)
            if d <= 1e-9:
                continue

            # Distance-weighted repulsion, with a hard-core push to avoid overlap.
            if d <= R:
                away = rg.Vector3d(self.position - other.position)
                if away.Length > 1e-9:
                    away.Unitize()
                    falloff = max(0.0, (R - d) / R)
                    if d < hard_core:
                        hc = max(0.0, (hard_core - d) / hard_core)
                        falloff *= (1.0 + (float(AGENT_HARDCORE_BOOST) * hc))
                    sep += away * falloff

            if d <= R_coh:
                coh_sum += rg.Vector3d(other.position - self.position)
                coh_count += 1

                # Neighborhood slope context + low-slope follower behavior.
                o_s = getattr(other, "slope_mag", None)
                if o_s is not None:
                    try:
                        o_s_val = max(0.0, min(1.0, float(o_s)))
                        local_slope_sum += o_s_val
                        local_slope_count += 1

                        if o_s_val > (s + slope_diff_min):
                            to_other = rg.Vector3d(other.position - self.position)
                            if to_other.Length > 1e-9:
                                to_other.Unitize()
                                w_sd = o_s_val - s
                                w_dist = max(0.0, (R_coh - d) / max(1e-9, R_coh))
                                peer_slope_vec += to_other * (w_sd * w_dist)
                    except:
                        pass

        # Keep repulsion magnitude (for crowd pressure), only cap extreme values.
        sep = project_to_tangent(sep, self.normal)
        sep_len = sep.Length
        if sep_len > 1e-9:
            sep_cap = max(1e-6, float(AGENT_SEP_VEC_CAP))
            if sep_len > sep_cap:
                sep *= (sep_cap / sep_len)
        else:
            sep = rg.Vector3d(0, 0, 0)

        coh = rg.Vector3d(0, 0, 0)
        if coh_count > 0:
            coh = rg.Vector3d(coh_sum) * (1.0 / float(coh_count))
            coh = project_to_tangent(coh, self.normal)
            if coh.Length > 1e-9:
                coh.Unitize()
            else:
                coh = rg.Vector3d(0, 0, 0)

        peer_slope = project_to_tangent(peer_slope_vec, self.normal)
        if peer_slope.Length > 1e-9:
            peer_slope.Unitize()
        else:
            peer_slope = rg.Vector3d(0, 0, 0)

        # Structural constraints (fixed neighbors from initial grid):
        # 1) spring toward rest edge lengths
        # 2) hard minimum edge length to resist local inversion/swapping
        struct_spring = rg.Vector3d(0, 0, 0)
        struct_min_push = rg.Vector3d(0, 0, 0)
        min_ratio = max(0.05, float(STRUCT_MIN_DIST_RATIO))
        if bool(STRUCT_ENABLE):
            n_ids = getattr(self, "struct_neighbors", [])
            n_rest = getattr(self, "struct_rest_lengths", [])
            n_count = min(len(n_ids), len(n_rest))
            for k_idx in range(n_count):
                oi = int(n_ids[k_idx])
                if oi < 0 or oi >= len(agents):
                    continue
                other = agents[oi]
                rest = max(1e-6, float(n_rest[k_idx]))
                to_other = rg.Vector3d(other.position - self.position)
                d = float(to_other.Length)
                if d <= 1e-9:
                    continue
                to_other.Unitize()

                # Hooke-like spring in direction of neighbor.
                stretch = (d - rest) / rest
                struct_spring += to_other * stretch

                # Minimum-length barrier.
                min_d = min_ratio * rest
                if d < min_d:
                    collapse = (min_d - d) / max(1e-9, min_d)
                    struct_min_push -= to_other * collapse

        struct_spring = project_to_tangent(struct_spring, self.normal)
        struct_min_push = project_to_tangent(struct_min_push, self.normal)

        # Steeper neighborhoods: more spacing pressure, a bit less cohesion.
        mean_slope_local = local_slope_sum / float(max(1, local_slope_count))
        sep_group_scale = 1.0 + (float(AGENT_GROUP_SLOPE_GAIN) * mean_slope_local)
        coh_group_scale = max(
            0.35,
            1.0 - (0.35 * float(AGENT_GROUP_SLOPE_GAIN) * mean_slope_local)
        )

        curv = rg.Vector3d(0, 0, 0)
        if self.curv_dir is not None:
            curv = rg.Vector3d(self.curv_dir)
            curv = project_to_tangent(curv, self.normal)
            if curv.Length > 1e-9:
                curv.Unitize()
            else:
                curv = rg.Vector3d(0, 0, 0)

        slope = rg.Vector3d(self.slope_seek)
        if slope.Length > 1e-9:
            slope.Unitize()

        # Home spring (to original uv point on surface).
        home_pt = self.surface.PointAt(self.uv0.X, self.uv0.Y)
        home = rg.Vector3d(home_pt - self.position)
        home = project_to_tangent(home, self.normal)
        if home.Length > 1e-9:
            home.Unitize()
        else:
            home = rg.Vector3d(0, 0, 0)

        # Noise (3D, then tangent).
        noise = rg.Vector3d(
            random.uniform(-1.0, 1.0),
            random.uniform(-1.0, 1.0),
            random.uniform(-1.0, 1.0)
        )
        noise = project_to_tangent(noise, self.normal)
        if noise.Length > 1e-9:
            noise.Unitize()
        else:
            noise = rg.Vector3d(0, 0, 0)

        # Combine.
        move = (
            (sep * (w_sep * sep_group_scale)) +
            (coh * (w_coh * coh_group_scale)) +
            (peer_slope * w_peer) +
            (struct_spring * w_struct_spring) +
            (struct_min_push * w_struct_min) +
            (curv * w_curv) +
            (slope * w_slope) +
            (home * w_home) +
            (noise * w_noise)
        )

        # Tangent projection safety.
        move = project_to_tangent(move, self.normal)

        # Directional continuity.
        if hasattr(self, "velocity") and self.velocity is not None and self.velocity.Length > 1e-9:
            vdir = rg.Vector3d(self.velocity)
            vdir = project_to_tangent(vdir, self.normal)
            if vdir.Length > 1e-9:
                vdir.Unitize()
                m = clamp01(float(self.momentum))
                move = (move * (1.0 - m)) + (vdir * m)

        if move.Length > 1e-9:
            move.Unitize()
        else:
            move = rg.Vector3d(0, 0, 0)

        # Store per-step movement.
        self.step_len = speed
        self.move_dir = move
        self.rep_radius = R

    def move(self):
        prev = rg.Point3d(self.position)

        if not hasattr(self, "move_dir") or self.move_dir.IsZero:
            self.velocity = rg.Vector3d(0, 0, 0)
            return

        proposed = self.position + self.move_dir * self.step_len

        ok, u2, v2 = self.surface.ClosestPoint(proposed)
        if ok:
            du = self.surface.Domain(0)
            dv = self.surface.Domain(1)
            u2 = clamp_param(u2, du)
            v2 = clamp_param(v2, dv)
            self.uv = rg.Point2d(u2, v2)
            self.position = rg.Point3d(self.surface.PointAt(u2, v2))

        self.velocity = rg.Vector3d(self.position - prev)

    def update(self, agents):
        self.sense(agents)
        self.decide(agents)
        self.move()

# ---------------------------------------------------------------------------
# Agent builder from seed points
# ---------------------------------------------------------------------------
def build_agents_from_seed(surface, seed_points, max_speed, seed_val=None):
    pts_raw = iter_any(seed_points)
    pts3 = []
    for pt in pts_raw:
        p3 = to_point3d(pt)
        if p3 is not None:
            pts3.append(p3)

    # Fallback: if no explicit seed points, seed a regular UV lattice.
    if (not pts3) and (surface is not None):
        div_u = as_int(FALLBACK_DIV_U, 8, min_value=1)
        div_v = as_int(FALLBACK_DIV_V, 8, min_value=1)
        du = surface.Domain(0)
        dv = surface.Domain(1)
        for i in range(div_u + 1):
            u = du.T0 + (float(i) / float(div_u)) * (du.T1 - du.T0)
            for j in range(div_v + 1):
                v = dv.T0 + (float(j) / float(div_v)) * (dv.T1 - dv.T0)
                pts3.append(surface.PointAt(u, v))

    # Internal slope-biased seeding (configured at top of file).
    if SEED_INIT_AGENT_COUNT is None:
        init_agent_count = len(pts3)
    else:
        init_agent_count = as_int(SEED_INIT_AGENT_COUNT, len(pts3), min_value=1)
    seed_slope_bias = clamp01(float(SEED_SLOPE_BIAS))
    seed_slope_power = max(0.1, float(SEED_SLOPE_POWER))

    pts3_selected, sel_dbg = select_seed_points(
        surface,
        pts3,
        init_agent_count,
        seed_slope_bias,
        seed_slope_power,
        seed_val
    )

    agents = []
    uvs = []
    poss = []

    for p3 in pts3_selected:
        ok, u, v = surface.ClosestPoint(p3)
        if not ok:
            continue
        uv = rg.Point2d(u, v)
        a = Agent(surface, uv, max_speed, idx=len(agents))
        agents.append(a)
        uvs.append(key2(u, v))
        poss.append(key3(a.position))

    struct_info = assign_structural_links(agents, surface)

    dbg = (
        "seed_raw:{0} seed_coerced:{1} seed_selected:{2} agents:{3} "
        "unique_uv:{4} unique_pos:{5} unique_seed:{6} "
        "slope_bias:{7:.3f} slope_power:{8:.3f} "
        "struct:{9} dims:{10}x{11} links:{12}"
    ).format(
        len(pts_raw), len(pts3), sel_dbg[1], len(agents),
        len(set(uvs)), len(set(poss)), len(set([key3(p) for p in pts3_selected])),
        float(clamp01(seed_slope_bias)), float(seed_slope_power),
        "on" if bool(struct_info.get("enabled", False)) else "off:" + str(struct_info.get("reason", "na")),
        int(struct_info.get("u_count", 0)),
        int(struct_info.get("v_count", 0)),
        int(struct_info.get("links", 0))
    )
    return agents, dbg, pts3_selected

# ---------------------------------------------------------------------------
# Grasshopper script entry
# ---------------------------------------------------------------------------
class MyComponent(Grasshopper.Kernel.GH_ScriptInstance):
    def RunScript(self,
            reset,
            base_surface,
            seed,
            max_speed,
            seed_points: list[object]):
        seed_everything(seed)
        srf = coerce_surface_face(base_surface)

        if reset or not hasattr(self, "agents") or not hasattr(self, "_inited"):
            if srf is None:
                self.agents = []
                self.dbg = "ERROR: base_surface is None or could not be coerced"
                self.seed_preview = []
            else:
                self.agents, self.dbg, self.seed_preview = build_agents_from_seed(
                    srf, seed_points, max_speed, seed
                )
            self._inited = True

        agents = getattr(self, "agents", [])
        dbg = getattr(self, "dbg", "")
        seed_preview = getattr(self, "seed_preview", [])

        # Return tuple arity to match current GH output-port count.
        out_count = 1
        try:
            out_count = int(self.Component.Params.Output.Count)
        except:
            out_count = 1

        if out_count <= 1:
            return (agents,)
        if out_count == 2:
            return agents, dbg
        return agents, dbg, seed_preview
# ---------- end agent_builder ----------
agent_simulator = Python3Script(agents=agent_builder, step=Button(), reset=button)  # -> agents, P, V, D; inputs agents: list
# ---------- agent_simulator: Python ----------
import scriptcontext as sc
import Rhino.Geometry as rg

# ---------------------------------------------------------------------------
# INPUT CONTRACT (Grasshopper)
# ---------------------------------------------------------------------------
# Inputs:
# - agents : list[Agent] from agent_builder (preferred)
# - step   : bool. Advances simulation only on rising edge (False->True)
# - reset  : bool (optional). Resets agents to their start UV/position
#
# Backward compatibility:
# - If `agents` input is not wired, script will try legacy `x.agents`.
#
# Outputs:
# - agents / agents_out : updated agent list
# - P                   : list[Point3d] agent positions
# - V                   : list[Line] velocity vectors
# - D                   : debug string
# ---------------------------------------------------------------------------


def as_bool(value, default=False):
    if value is None:
        return bool(default)
    if isinstance(value, bool):
        return value
    s = str(value).strip().lower()
    if s in ("1", "true", "t", "yes", "y", "on"):
        return True
    if s in ("0", "false", "f", "no", "n", "off"):
        return False
    return bool(default)


def iter_any(obj):
    if obj is None:
        return []
    try:
        return [x for x in obj]
    except:
        return [obj]


# ---------------------------------------------------------------------------
# Read inputs
# ---------------------------------------------------------------------------
in_agents = globals().get("agents", None)
if in_agents is None:
    # Legacy fallback: previous setup passed builder component instance as x.
    x = globals().get("x", None)
    if x is not None and hasattr(x, "agents"):
        in_agents = getattr(x, "agents", None)

agents_state = iter_any(in_agents)
step_flag = as_bool(globals().get("step", False), False)
reset_flag = as_bool(globals().get("reset", False), False)


# ---------------------------------------------------------------------------
# Sticky state (edge-trigger stepping)
# ---------------------------------------------------------------------------
guid = str(ghenv.Component.InstanceGuid)
k_prev = "A4_prev_step_" + guid
k_step = "A4_step_count_" + guid

if k_prev not in sc.sticky:
    sc.sticky[k_prev] = False
if k_step not in sc.sticky:
    sc.sticky[k_step] = 0

do_step = (step_flag is True) and (sc.sticky[k_prev] is False)
sc.sticky[k_prev] = step_flag


# ---------------------------------------------------------------------------
# Optional reset + simulation step
# ---------------------------------------------------------------------------
if reset_flag:
    for a in agents_state:
        uv0 = getattr(a, "uv0", None)
        srf = getattr(a, "surface", None)
        if (uv0 is not None) and (srf is not None):
            try:
                a.uv = rg.Point2d(uv0.X, uv0.Y)
                a.position = rg.Point3d(srf.PointAt(uv0.X, uv0.Y))
            except:
                pass
        try:
            a.velocity = rg.Vector3d(0, 0, 0)
        except:
            pass
        try:
            a.age = 0
        except:
            pass
        try:
            a.spawn_cooldown = 0
        except:
            pass

prev_pos = {}
for a in agents_state:
    p = getattr(a, "position", None)
    if p is not None:
        prev_pos[id(a)] = rg.Point3d(p)

update_fail_count = 0
if do_step and agents_state:
    for a in agents_state:
        try:
            a.update(agents_state)
        except:
            # Keep stepping robust if one agent fails.
            update_fail_count += 1

        # Ensure velocity reflects actual displacement this step.
        # This makes V robust even if an Agent implementation does not set velocity.
        p_prev = prev_pos.get(id(a), None)
        p_now = getattr(a, "position", None)
        if p_prev is not None and p_now is not None:
            try:
                a.velocity = rg.Vector3d(rg.Point3d(p_now) - p_prev)
            except:
                pass
    sc.sticky[k_step] = int(sc.sticky.get(k_step, 0)) + 1


# ---------------------------------------------------------------------------
# Outputs
# ---------------------------------------------------------------------------
P = []
V = []
for a in agents_state:
    p = getattr(a, "position", None)
    if p is None:
        continue
    p3 = rg.Point3d(p)
    P.append(p3)

    vel = getattr(a, "velocity", None)
    if vel is not None and vel.Length > 1e-9:
        V.append(rg.Line(p3, p3 + vel))

agents = agents_state      # Preferred output name.
agents_out = agents_state  # Alias output name.

D = "agents:{0} step_count:{1} stepped:{2} reset:{3}".format(
    len(agents_state),
    int(sc.sticky.get(k_step, 0)),
    do_step,
    reset_flag
)
if update_fail_count > 0:
    D += " update_fail:{0}".format(update_fail_count)
# ---------- end agent_simulator ----------
panel = Panel(agent_simulator.D)
pt_2 = Point(agent_simulator.P)
geo = Geometry(agent_simulator.V)
mesh_formation = Python3Script(run=Toggle(True), base_surface=py3.out_surface, points=pt_2)  # -> out_mesh, out_edges, dbg; inputs points: list of Point3d
# ---------- mesh_formation: Python ----------
import Rhino.Geometry as rg
import rhinoscriptsyntax as rs

# ---------------------------------------------------------------------------
# INPUT CONTRACT (Grasshopper)
# ---------------------------------------------------------------------------
# Inputs:
# - run          : bool. When False, no mesh is generated.
# - base_surface : Surface/BrepFace/Brep (if Brep, first face is used)
# - points       : moving points (typically simulator P output)
#
# Outputs:
# - out_mesh  : dynamic triangle mesh (UV Delaunay rebuilt each solve)
# - out_edges : mesh boundary lines
# - dbg       : debug string
# ---------------------------------------------------------------------------


# ---------------------------------------------------------------------------
# Helpers
# ---------------------------------------------------------------------------
def as_list(x):
    if x is None:
        return []
    try:
        items = list(x)
    except:
        return [x]

    # One-level unwrap for common GH case: (points_list,)
    if len(items) == 1:
        only = items[0]
        try:
            nested = list(only)
            if len(nested) > 0:
                return nested
        except:
            pass
    return items


def as_bool(v, default=False):
    if v is None:
        return bool(default)
    if isinstance(v, bool):
        return v
    s = str(v).strip().lower()
    if s in ("1", "true", "t", "yes", "y", "on"):
        return True
    if s in ("0", "false", "f", "no", "n", "off"):
        return False
    return bool(default)


def as_int(v, default, min_value=None):
    try:
        out = int(v)
    except:
        out = int(default)
    if min_value is not None and out < min_value:
        out = int(min_value)
    return out


def as_float(v, default):
    try:
        return float(v)
    except:
        return float(default)


def clamp01(x):
    if x < 0.0:
        return 0.0
    if x > 1.0:
        return 1.0
    return x


def clamp(v, lo, hi):
    if v < lo:
        return lo
    if v > hi:
        return hi
    return v


def to_point3d(obj):
    """
    Robust point coercion for GH wiring variants:
    - Point3d / point-like objects
    - wrapped objects with .Location
    - Agent objects with .position
    """
    if obj is None:
        return None

    # Agent-like object from simulator/builder.
    if hasattr(obj, "position"):
        try:
            return rg.Point3d(obj.position)
        except:
            pass

    p = getattr(obj, "Location", obj)
    try:
        return rg.Point3d(p)
    except:
        pass
    try:
        return rg.Point3d(float(p.X), float(p.Y), float(p.Z))
    except:
        return None


def coerce_face(base_surface):
    srf = getattr(base_surface, "Geometry", base_surface)

    try:
        import System
        if isinstance(srf, System.Guid):
            srf = rs.coercesurface(srf) or rs.coercebrep(srf)
    except:
        pass

    if isinstance(srf, rg.Brep):
        if srf.Faces.Count == 0:
            return None
        srf = srf.Faces[0]

    if not isinstance(srf, (rg.Surface, rg.BrepFace)):
        return None

    return srf


def project_points_to_uv(surface, pts):
    uv = []
    valid_pts = []
    bad = 0
    for p in pts:
        p3 = to_point3d(p)
        if p3 is None:
            bad += 1
            continue

        ok, u, v = surface.ClosestPoint(p3)
        if not ok:
            bad += 1
            continue

        uv.append((float(u), float(v)))
        valid_pts.append(p3)

    return uv, valid_pts, bad


def infer_grid_dims(n, aspect_uv):
    """
    Infer (u_count, v_count) from number of points using factor pairs.
    Chooses pair whose u/v ratio best matches surface UV aspect.
    """
    if n < 4:
        return None

    candidates = []
    r = int(n ** 0.5)
    for a in range(2, r + 1):
        if n % a != 0:
            continue
        b = n // a
        candidates.append((a, b))
        if a != b:
            candidates.append((b, a))

    if not candidates:
        return None

    best = None
    best_err = None
    target = max(1e-9, float(aspect_uv))
    for u_count, v_count in candidates:
        ratio = float(u_count) / float(v_count)
        err = abs(ratio - target)
        if (best_err is None) or (err < best_err):
            best_err = err
            best = (u_count, v_count)

    return best


def build_quad_faces(u_count, v_count):
    """
    Flat index convention: idx = i * v_count + j
    where i in [0, u_count-1], j in [0, v_count-1].
    """
    quads = []
    for i in range(u_count - 1):
        for j in range(v_count - 1):
            a = i * v_count + j
            b = (i + 1) * v_count + j
            c = (i + 1) * v_count + (j + 1)
            d = i * v_count + (j + 1)
            quads.append((a, b, c, d))
    return quads


# -----------------------
# Optional fallback triangulation
# -----------------------
def orient2d(ax, ay, bx, by, cx, cy):
    return (bx - ax) * (cy - ay) - (by - ay) * (cx - ax)


def circumcircle_contains(ax, ay, bx, by, cx, cy, px, py):
    ax -= px
    ay -= py
    bx -= px
    by -= py
    cx -= px
    cy -= py

    a2 = ax * ax + ay * ay
    b2 = bx * bx + by * by
    c2 = cx * cx + cy * cy

    det = (ax * (by * c2 - b2 * cy) -
           ay * (bx * c2 - b2 * cx) +
           a2 * (bx * cy - by * cx))
    return det > 1e-12


def delaunay_triangulate_2d(pts):
    n = len(pts)
    if n < 3:
        return []

    xs = [p[0] for p in pts]
    ys = [p[1] for p in pts]
    minx, maxx = min(xs), max(xs)
    miny, maxy = min(ys), max(ys)
    dmax = max(maxx - minx, maxy - miny)
    if dmax == 0.0:
        return []

    mx = 0.5 * (minx + maxx)
    my = 0.5 * (miny + maxy)

    p0 = (mx - 20 * dmax, my - dmax)
    p1 = (mx, my + 20 * dmax)
    p2 = (mx + 20 * dmax, my - dmax)

    pts_ext = pts + [p0, p1, p2]
    s0, s1, s2 = n, n + 1, n + 2
    tris = [(s0, s1, s2)]

    for i in range(n):
        px, py = pts_ext[i]
        bad = []

        for t in tris:
            ia, ib, ic = t
            ax, ay = pts_ext[ia]
            bx, by = pts_ext[ib]
            cx, cy = pts_ext[ic]

            if orient2d(ax, ay, bx, by, cx, cy) < 0.0:
                bx, by, cx, cy = cx, cy, bx, by

            if circumcircle_contains(ax, ay, bx, by, cx, cy, px, py):
                bad.append(t)

        edge_count = {}

        def add_edge(a, b):
            if a > b:
                a, b = b, a
            edge_count[(a, b)] = edge_count.get((a, b), 0) + 1

        for ia, ib, ic in bad:
            add_edge(ia, ib)
            add_edge(ib, ic)
            add_edge(ic, ia)

        if bad:
            bad_set = set(bad)
            tris = [t for t in tris if t not in bad_set]

        boundary = [e for e, c in edge_count.items() if c == 1]
        for a, b in boundary:
            tris.append((a, b, i))

    out = []
    for a, b, c in tris:
        if a >= n or b >= n or c >= n:
            continue
        if a == b or b == c or c == a:
            continue
        out.append((a, b, c))

    return out


# ---------------------------------------------------------------------------
# Main
# ---------------------------------------------------------------------------
out_mesh = None
out_edges = []
dbg = ""

run_flag = as_bool(globals().get("run", True), True)

if not run_flag:
    dbg = "run is False"
else:
    srf = coerce_face(globals().get("base_surface", None))
    pts = as_list(globals().get("points", None))

    if srf is None:
        dbg = "ERROR: base_surface is invalid"
    elif len(pts) < 3:
        dbg = "ERROR: need at least 3 points"
    else:
        uv_pts, valid_pts, bad = project_points_to_uv(srf, pts)
        n = len(uv_pts)

        if n < 3:
            dbg = "ERROR: <3 valid projected points (bad={})".format(bad)
        else:
            dom_u = srf.Domain(0)
            dom_v = srf.Domain(1)
            du = float(dom_u.T1 - dom_u.T0)
            dv = float(dom_v.T1 - dom_v.T0)
            if du == 0.0 or dv == 0.0:
                dbg = "ERROR: surface domain is degenerate"
            else:
                # Option 1: dynamic topology. Rebuild Delaunay connectivity every solve.
                uv_norm = []
                for (u, v) in uv_pts:
                    un = clamp01((u - float(dom_u.T0)) / du)
                    vn = clamp01((v - float(dom_v.T0)) / dv)
                    uv_norm.append((un, vn))

                tris = delaunay_triangulate_2d(uv_norm)
                if len(tris) == 0:
                    dbg = "ERROR: dynamic triangulation returned 0 triangles"
                else:
                    mesh = rg.Mesh()
                    for (u, v) in uv_pts:
                        u_clamp = clamp(u, float(dom_u.T0), float(dom_u.T1))
                        v_clamp = clamp(v, float(dom_v.T0), float(dom_v.T1))
                        mesh.Vertices.Add(srf.PointAt(u_clamp, v_clamp))

                    for (a, b, c) in tris:
                        mesh.Faces.AddFace(int(a), int(b), int(c))

                    mesh.Normals.ComputeNormals()
                    mesh.Compact()
                    out_mesh = mesh

                    edge_set = set()
                    for f in mesh.Faces:
                        if not f.IsTriangle:
                            continue
                        A, B, C = f.A, f.B, f.C
                        for i, j in ((A, B), (B, C), (C, A)):
                            if i > j:
                                i, j = j, i
                            edge_set.add((i, j))

                    for i, j in edge_set:
                        out_edges.append(rg.Line(mesh.Vertices[i], mesh.Vertices[j]))

                    dbg = "OK(dynamic_tris): input:{} valid:{} bad:{} tris:{} edges:{} topology:rebuilt".format(
                        len(pts), n, bad, mesh.Faces.Count, len(edge_set)
                    )
# ---------- end mesh_formation ----------
panel_2 = Panel(mesh_formation.dbg)
crv = Curve(mesh_formation.out_edges)
delaunay_mesh = DelaunayMesh(Points=pt_2, Plane=PlaneXY(0, 0, 0))
preview = CustomPreview(Geometry=delaunay_mesh, Material=ColourSwatch(SwatchColor=RGB(240, 240, 240)))
medges = MeshEdges(Mesh=delaunay_mesh)  # -> NakedEdges, InteriorEdges, NonManifoldEdges
preview_2 = CustomPreview(Geometry=medges.InteriorEdges, Material=ColourSwatch(SwatchColor=RGB(3, 3, 3)))
