# Grasshopper definition surface_panelization.gh (Grasshopper 1.0.8)

srf = Surface(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)
area = Area(Geometry=srf)  # -> Area, Centroid
Z = UnitZ(Factor=Slider(20, range=0..100))
number_slider = Slider(30, range=0..1000)
number_slider_2 = Slider(15, range=0..1000)
number_slider_3 = Slider(10, range=0..100)
scale = Scale(Geometry=srf, Center=area.Centroid, Factor=0.5)  # -> Geometry, Transform
neg = Negative(Value=Z)
move = Move(Geometry=scale.Geometry, Motion=neg)  # -> Geometry, Transform
py3 = Python3Script(
    base_surface=move.Geometry,
    divU=number_slider_2,
    divV=number_slider_2,
    point_divU=number_slider,
    point_divV=number_slider,
    frequency=Slider(4, range=0..10),
    phase=Slider(5, range=0..10),
    amplitude=Slider(3, range=0..10),
    lift=Slider(0, range=0..1),
    heightmap_type=Slider(1, range=0..100),
    seed=number_slider_3,
    terrain_complexity=Slider(0.21, range=0..1),
    terrain_steepness=Slider(0.7, range=0..1))  # -> out_surface, out_points, srf_id
# ---------- py3: Python ----------
#r: numpy
import Rhino.Geometry as rg
import rhinoscriptsyntax as rs
import numpy as np
import random
import math

# ---------------------------------------------------------------------------
# INPUT CONTRACT (Grasshopper)
# ---------------------------------------------------------------------------
# Required inputs:
# - base_surface : Surface/BrepFace/Brep (if Brep, first face is used)
# - divU         : int, U subdivisions used to rebuild out_surface
# - divV         : int, V subdivisions used to rebuild out_surface
# - frequency    : float, wave frequency for the displacement field
# - phase        : float, wave phase shift
# - amplitude    : float, displacement amplitude along surface normal
# - lift         : float, global Z offset after displacement
#
# Optional inputs:
# - seed            : int, deterministic seed (mainly for noise mode)
# - heightmap_type  : int (0 = wave+bump, 1 = radial falloff + deterministic noise)
#
# - point_divU      : int, optional output-point U subdivisions (independent of divU)
# - point_divV      : int, optional output-point V subdivisions (independent of divV)
#   Aliases supported: seed_divU/seed_divV, out_divU/out_divV
#
# - terrain_complexity : float in [0,1]. Higher = more detail + more macro variation
# - terrain_steepness  : float in [0,1]. Higher = sharper ridges + steeper transitions
#
# Outputs:
# - out_surface : generated displaced surface (NurbsSurface or Brep fallback)
# - out_points  : flattened displaced Point3d list (uniform grid by point_divU/point_divV)
# - srf_id      : compatibility output (always None in this RhinoCommon workflow)
# ---------------------------------------------------------------------------


def coerce_face_or_surface(geo):
    g = getattr(geo, "Geometry", geo)
    try:
        import System
        if isinstance(g, System.Guid):
            g = rs.coercesurface(g) or rs.coercebrep(g)
    except:
        pass
    if isinstance(g, rg.Brep) and g.Faces.Count > 0:
        return g.Faces[0]
    return g


def as_int(value, default, min_value=None):
    try:
        out = int(value)
    except:
        out = int(default)
    if min_value is not None and out < min_value:
        out = int(min_value)
    return out


def as_float(value, default, min_value=None):
    try:
        out = float(value)
    except:
        out = float(default)
    if min_value is not None and out < min_value:
        out = float(min_value)
    return out

def clamp01(x):
    if x < 0.0:
        return 0.0
    if x > 1.0:
        return 1.0
    return x


def eval_point_normal(srf_obj, u, v):
    pt = srf_obj.PointAt(u, v)
    n = srf_obj.NormalAt(u, v)
    if (not n.IsValid) or n.IsZero:
        n = rg.Vector3d(0, 0, 1)
    else:
        n.Unitize()
    return pt, n


def deterministic_noise(un, vn, seed_val):
    # Deterministic pseudo-noise in [-1, 1], independent of grid resolution.
    n = np.sin((12.9898 * un) + (78.233 * vn) + (37.719 * float(seed_val))) * 43758.5453
    frac = n - np.floor(n)
    return (frac * 2.0) - 1.0

def value_noise_2d(un, vn, cells_u, cells_v, seed_val):
    """
    Smooth value noise sampled from a random lattice with bilinear interpolation.
    Output range: [0, 1].
    """
    cu = max(1, int(cells_u))
    cv = max(1, int(cells_v))
    rng = np.random.RandomState(int(seed_val))
    lattice = rng.rand(cu + 1, cv + 1)

    x = np.minimum(un * float(cu), float(cu) - 1e-9)
    y = np.minimum(vn * float(cv), float(cv) - 1e-9)

    xi = np.floor(x).astype(np.int32)
    yi = np.floor(y).astype(np.int32)
    xf = x - xi
    yf = y - yi

    # Smoothstep interpolation for gentler slope transitions.
    sx = xf * xf * (3.0 - 2.0 * xf)
    sy = yf * yf * (3.0 - 2.0 * yf)

    xi1 = xi + 1
    yi1 = yi + 1

    v00 = lattice[xi, yi]
    v10 = lattice[xi1, yi]
    v01 = lattice[xi, yi1]
    v11 = lattice[xi1, yi1]

    a = v00 + (v10 - v00) * sx
    b = v01 + (v11 - v01) * sx
    return a + (b - a) * sy

def fbm_noise_2d(un, vn, base_cells, octaves, roughness, lacunarity, seed_val):
    """
    Fractal Brownian motion noise from value-noise octaves.
    Output range: approximately [0, 1].
    """
    octv = max(1, int(octaves))
    amp = 1.0
    sum_amp = 0.0
    out = np.zeros_like(un, dtype=float)
    cells = max(1.0, float(base_cells))

    for o in range(octv):
        n = value_noise_2d(un, vn, int(round(cells)), int(round(cells)), int(seed_val) + (o * 1013))
        out += amp * n
        sum_amp += amp
        amp *= float(roughness)
        cells *= float(lacunarity)

    if sum_amp > 1e-12:
        out /= sum_amp
    return out

def random_terrain_field(un, vn, amp, freq, seed_val, opts):
    """
    Random terrain with mixed low/high slope zones:
    - multi-octave smooth noise
    - optional ridged mixing
    - macro hill/valley blobs
    """
    octaves = int(opts.get("octaves", 5))
    roughness = float(opts.get("roughness", 0.55))
    lacunarity = float(opts.get("lacunarity", 2.0))
    ridge_mix = clamp01(float(opts.get("ridge_mix", 0.35)))
    peak_count = max(0, int(opts.get("peak_count", 6)))
    peak_strength = max(0.0, float(opts.get("peak_strength", 0.6)))
    contrast = max(0.1, float(opts.get("contrast", 1.5)))

    base_cells = max(1.0, 2.0 * max(0.25, float(freq)))

    fbm = fbm_noise_2d(un, vn, base_cells, octaves, roughness, lacunarity, seed_val)
    base = (fbm * 2.0) - 1.0

    # Ridged variant emphasizes steeper transitions.
    ridged01 = 1.0 - np.abs(base)
    ridged = (ridged01 * 2.0) - 1.0
    terrain = ((1.0 - ridge_mix) * base) + (ridge_mix * ridged)

    # Add macro hills/valleys to create broad low/high slope regions.
    if peak_count > 0 and peak_strength > 1e-12:
        rng = np.random.RandomState(int(seed_val) + 7919)
        macro = np.zeros_like(un, dtype=float)
        for _ in range(peak_count):
            cx = rng.rand()
            cy = rng.rand()
            sigma = rng.uniform(0.08, 0.28)
            h = rng.uniform(-1.0, 1.0)
            d2 = ((un - cx) ** 2 + (vn - cy) ** 2) / max(1e-9, sigma * sigma)
            macro += h * np.exp(-0.5 * d2)
        m = np.max(np.abs(macro))
        if m > 1e-12:
            macro /= m
        terrain = ((1.0 - peak_strength) * terrain) + (peak_strength * macro)

    # Contrast boost for clearer steep/flat distinctions.
    terrain = np.tanh(contrast * terrain)
    return float(amp) * terrain


def terrain_options_from_controls(complexity, steepness):
    """
    Map two user-friendly controls to full random-terrain parameters.
    """
    c = clamp01(float(complexity))
    s = clamp01(float(steepness))

    octaves = int(round(3.0 + 5.0 * c))          # 3..8
    roughness = max(0.25, 0.72 - 0.27 * c)       # ~0.72..0.45
    lacunarity = 1.5 + 1.0 * c                   # 1.5..2.5
    ridge_mix = clamp01(0.10 + 0.80 * s)         # 0.1..0.9
    peak_count = int(round(2.0 + 8.0 * c))       # 2..10
    peak_strength = clamp01(0.20 + 0.65 * c)     # 0.2..0.85
    contrast = 0.9 + 2.2 * s                     # 0.9..3.1

    return {
        "octaves": octaves,
        "roughness": roughness,
        "lacunarity": lacunarity,
        "ridge_mix": ridge_mix,
        "peak_count": peak_count,
        "peak_strength": peak_strength,
        "contrast": contrast
    }


def evaluate_height_field(un, vn, amp, freq, phs, heightmap_type, seed_val, terrain_opts=None):
    if int(heightmap_type) == 0:
        wave = np.sin((2.0 * math.pi * freq * (un + vn)) + phs)
        dist = np.sqrt((un - 0.5) ** 2 + (vn - 0.5) ** 2)
        bump = np.exp(-5.0 * dist ** 2)
        return amp * (0.6 * wave + 0.4 * bump)

    # Richer random terrain mode (type 1).
    return random_terrain_field(un, vn, amp, freq, seed_val, terrain_opts or {})


def sample_displaced_grid(
    srf_obj,
    dom_u,
    dom_v,
    u_div,
    v_div,
    amp,
    freq,
    phs,
    heightmap_type,
    lift_val,
    seed_val,
    terrain_opts=None
):
    # Parameter-space sampling.
    u_vals = np.linspace(dom_u.T0, dom_u.T1, u_div + 1)
    v_vals = np.linspace(dom_v.T0, dom_v.T1, v_div + 1)
    Ug, Vg = np.meshgrid(u_vals, v_vals, indexing="ij")

    # Normalized UV for displacement field evaluation.
    un = np.linspace(0.0, 1.0, u_div + 1)
    vn = np.linspace(0.0, 1.0, v_div + 1)
    Un, Vn = np.meshgrid(un, vn, indexing="ij")

    H = evaluate_height_field(Un, Vn, amp, freq, phs, heightmap_type, seed_val, terrain_opts)

    pts_grid = [[None] * (v_div + 1) for _ in range(u_div + 1)]
    pts_flat = []

    for i in range(u_div + 1):
        for j in range(v_div + 1):
            pt, n = eval_point_normal(srf_obj, float(Ug[i, j]), float(Vg[i, j]))
            p = pt + n * float(H[i, j])
            p3 = rg.Point3d(float(p.X), float(p.Y), float(p.Z + lift_val))
            pts_grid[i][j] = p3
            pts_flat.append(p3)

    return pts_grid, pts_flat


def build_surface_candidates(pts_grid, u_count, v_count, deg_u, deg_v):
    pts_a = [pts_grid[i][j] for i in range(u_count) for j in range(v_count)]
    pts_b = [pts_grid[i][j] for j in range(v_count) for i in range(u_count)]

    srf_a = rg.NurbsSurface.CreateThroughPoints(pts_a, u_count, v_count, deg_u, deg_v, False, False)
    srf_b = rg.NurbsSurface.CreateThroughPoints(pts_b, u_count, v_count, deg_u, deg_v, False, False)
    return srf_a, pts_a, srf_b, pts_b


def loft_surface_from_grid(pts_grid, u_count, v_count, along_u=True):
    curves = []
    if along_u:
        for i in range(u_count):
            row_pts = [pts_grid[i][j] for j in range(v_count)]
            pl = rg.Polyline(row_pts)
            if pl.IsValid and pl.Count >= 2:
                curves.append(pl.ToNurbsCurve())
    else:
        for j in range(v_count):
            col_pts = [pts_grid[i][j] for i in range(u_count)]
            pl = rg.Polyline(col_pts)
            if pl.IsValid and pl.Count >= 2:
                curves.append(pl.ToNurbsCurve())

    if len(curves) < 2:
        return None

    breps = rg.Brep.CreateFromLoft(
        curves,
        rg.Point3d.Unset,
        rg.Point3d.Unset,
        rg.LoftType.Normal,
        False
    )
    if breps and len(breps) > 0 and breps[0] and breps[0].IsValid:
        return breps[0]
    return None


def first_face_surface(brep_obj):
    if brep_obj and isinstance(brep_obj, rg.Brep) and brep_obj.Faces.Count > 0:
        return brep_obj.Faces[0].ToNurbsSurface()
    return None


# ---------------------------------------------------------------------------
# INPUT NORMALIZATION
# ---------------------------------------------------------------------------
IN_base_surface = globals().get("base_surface", None)
IN_seed = globals().get("seed", None)
IN_divU = globals().get("divU", 24)
IN_divV = globals().get("divV", 24)
IN_frequency = globals().get("frequency", 1.0)
IN_phase = globals().get("phase", 0.0)
IN_amplitude = globals().get("amplitude", 1.0)
IN_lift = globals().get("lift", 0.0)
IN_heightmap_type = globals().get("heightmap_type", 0)
IN_terrain_complexity = globals().get("terrain_complexity", 0.6)
IN_terrain_steepness = globals().get("terrain_steepness", 0.6)

# Independent output-point density controls.
IN_point_divU = globals().get(
    "point_divU",
    globals().get("seed_divU", globals().get("out_divU", IN_divU))
)
IN_point_divV = globals().get(
    "point_divV",
    globals().get("seed_divV", globals().get("out_divV", IN_divV))
)

U = as_int(IN_divU, 24, min_value=1)
V = as_int(IN_divV, 24, min_value=1)
U_pts = as_int(IN_point_divU, U, min_value=1)
V_pts = as_int(IN_point_divV, V, min_value=1)

freq = as_float(IN_frequency, 1.0)
phs = as_float(IN_phase, 0.0)
amp = as_float(IN_amplitude, 1.0)
lift_val = as_float(IN_lift, 0.0)
heightmap_type = as_int(IN_heightmap_type, 0, min_value=0)
terrain_complexity = clamp01(as_float(IN_terrain_complexity, 0.6))
terrain_steepness = clamp01(as_float(IN_terrain_steepness, 0.6))

seed_i = 0
if IN_seed is not None:
    try:
        seed_i = int(IN_seed)
    except:
        seed_i = 0
random.seed(seed_i)
np.random.seed(seed_i)

terrain_opts = terrain_options_from_controls(terrain_complexity, terrain_steepness)


# ---------------------------------------------------------------------------
# OUTPUTS
# ---------------------------------------------------------------------------
out_surface = None
out_points = []
srf_id = None  # Compatibility placeholder; no document object is created here.


# ---------------------------------------------------------------------------
# MAIN
# ---------------------------------------------------------------------------
srf_obj = coerce_face_or_surface(IN_base_surface)

if srf_obj is not None and isinstance(srf_obj, (rg.Surface, rg.BrepFace)):
    dom_u = srf_obj.Domain(0)
    dom_v = srf_obj.Domain(1)

    # 1) Build displaced grid used to reconstruct the output surface.
    pts_grid_surface, pts_flat_surface = sample_displaced_grid(
        srf_obj,
        dom_u,
        dom_v,
        U,
        V,
        amp,
        freq,
        phs,
        heightmap_type,
        lift_val,
        seed_i,
        terrain_opts
    )

    deg_u = 3 if (U + 1) >= 4 else max(1, U)
    deg_v = 3 if (V + 1) >= 4 else max(1, V)

    srf_a, pts_a, srf_b, pts_b = build_surface_candidates(
        pts_grid_surface, U + 1, V + 1, deg_u, deg_v
    )

    if srf_a and srf_a.IsValid:
        out_surface = srf_a
    elif srf_b and srf_b.IsValid:
        out_surface = srf_b
    else:
        loft_a = loft_surface_from_grid(pts_grid_surface, U + 1, V + 1, along_u=True)
        loft_b = loft_surface_from_grid(pts_grid_surface, U + 1, V + 1, along_u=False)

        if loft_a and loft_a.IsValid:
            out_surface = first_face_surface(loft_a) or loft_a
        elif loft_b and loft_b.IsValid:
            out_surface = first_face_surface(loft_b) or loft_b

    # 2) Build output points with independent density (for agent seeding/control).
    if (U_pts == U) and (V_pts == V):
        out_points = pts_flat_surface
    else:
        _, pts_flat_dense = sample_displaced_grid(
            srf_obj,
            dom_u,
            dom_v,
            U_pts,
            V_pts,
            amp,
            freq,
            phs,
            heightmap_type,
            lift_val,
            seed_i,
            terrain_opts
        )
        out_points = pts_flat_dense
# ---------- end py3 ----------

number_slider_4 = Slider(0.7, range=0..1)
button = Button()
agent_builder = Python3Script(reset=button, base_surface=py3.out_surface, seed=number_slider_3, max_speed=number_slider_4, seed_points=py3.out_points)  # -> agents; inputs seed_points: list
# ---------- agent_builder: Python ----------
import random
import numpy as np
import rhinoscriptsyntax as rs
import Rhino.Geometry as rg

# ---------------------------------------------------------------------------
# INPUT CONTRACT (Grasshopper)
# ---------------------------------------------------------------------------
# Inputs:
# - reset        : bool. Rebuilds agents when True.
# - base_surface : Surface/BrepFace/Brep (if Brep, first face is used)
# - seed         : int (optional). Seeds random + numpy for repeatability.
# - max_speed    : float. Base step length for each agent.
# - seed_points  : list[Point3d]. Required explicit seed points.
#
# Outputs:
# - agents       : list[Agent]
# - dbg          : debug string (if output port exists)
# - seed_preview : accepted seed points (if output port exists)
#
# Notes:
# - Builder no longer generates fallback seeds. Provide `seed_points`.
# - Main force defaults/controls live in `agent_simulator.py`.
# ---------------------------------------------------------------------------

# ---------------------------------------------------------------------------
# INTERNAL CONFIG
# ---------------------------------------------------------------------------
# Structural graph setup only. Force defaults live in agent_simulator.py.
STRUCT_CFG = {"grid_u": None, "grid_v": None, "use_diagonals": False}

# ---------------------------------------------------------------------------
# SCALAR HELPERS
# ---------------------------------------------------------------------------
def as_int(value, default, min_value=None):
    try:
        out = int(value)
    except:
        out = int(default)
    if min_value is not None and out < min_value:
        out = int(min_value)
    return out


def as_float(value, default, min_value=None):
    try:
        out = float(value)
    except:
        out = float(default)
    if min_value is not None and out < min_value:
        out = float(min_value)
    return out


def clamp01(x):
    return 0.0 if x < 0.0 else (1.0 if x > 1.0 else x)


def clamp_param(t, dom):
    return dom.T0 if t < dom.T0 else (dom.T1 if t > dom.T1 else t)

# ---------------------------------------------------------------------------
# INPUT COERCION
# ---------------------------------------------------------------------------
def seed_everything(seed):
    if seed is None:
        return
    try:
        s = int(seed)
    except:
        return
    random.seed(s)
    np.random.seed(s)


def coerce_surface_face(base_surface):
    srf_geo = getattr(base_surface, "Geometry", base_surface)
    try:
        import System
        if isinstance(srf_geo, System.Guid):
            srf_geo = rs.coercesurface(srf_geo)
    except:
        pass
    if isinstance(srf_geo, rg.Brep) and srf_geo.Faces.Count > 0:
        srf_geo = srf_geo.Faces[0]
    return srf_geo


def iter_any(obj):
    if obj is None:
        return []
    try:
        return [x for x in obj]
    except:
        return [obj]


def to_point3d(pt):
    p = getattr(pt, "Location", pt)
    try:
        c = rs.coerce3dpoint(p)
        return rg.Point3d(c[0], c[1], c[2])
    except:
        pass
    try:
        return rg.Point3d(p.X, p.Y, p.Z)
    except:
        return None


def project_to_tangent(v, n):
    return v - n * rg.Vector3d.Multiply(v, n)

# ---------------------------------------------------------------------------
# STRUCTURAL TOPOLOGY HELPERS
# ---------------------------------------------------------------------------
def infer_grid_dims(n, aspect_uv):
    n = as_int(n, 0, min_value=0)
    if n < 4:
        return None
    candidates = []
    r = int(n ** 0.5)
    for a in range(2, r + 1):
        if n % a != 0:
            continue
        b = n // a
        candidates.append((a, b))
        if a != b:
            candidates.append((b, a))
    if not candidates:
        return None
    target = max(1e-9, float(aspect_uv))
    best, best_err = None, None
    for u_count, v_count in candidates:
        err = abs((float(u_count) / float(v_count)) - target)
        if (best_err is None) or (err < best_err):
            best, best_err = (u_count, v_count), err
    return best


def assign_structural_links(agents, surface):
    for a in agents:
        a.struct_neighbors, a.struct_rest_lengths = [], []
    if not agents:
        return {"enabled": False, "reason": "empty", "u_count": 0, "v_count": 0, "links": 0}

    n = len(agents)
    u_count = v_count = None
    if (STRUCT_CFG.get("grid_u") is not None) and (STRUCT_CFG.get("grid_v") is not None):
        u_try = as_int(STRUCT_CFG["grid_u"], 0, min_value=2)
        v_try = as_int(STRUCT_CFG["grid_v"], 0, min_value=2)
        if (u_try * v_try) == n:
            u_count, v_count = u_try, v_try
    if (u_count is None) or (v_count is None):
        du = abs(float(surface.Domain(0).T1 - surface.Domain(0).T0))
        dv = abs(float(surface.Domain(1).T1 - surface.Domain(1).T0))
        dims = infer_grid_dims(n, (du / dv) if dv > 1e-12 else 1.0)
        if dims is not None:
            u_count, v_count = dims
    if (u_count is None) or (v_count is None) or (u_count < 2) or (v_count < 2) or ((u_count * v_count) != n):
        return {"enabled": False, "reason": "dims_not_inferred", "u_count": 0, "v_count": 0, "links": 0}

    offsets = [(-1, 0), (1, 0), (0, -1), (0, 1)]
    if bool(STRUCT_CFG.get("use_diagonals", False)):
        offsets += [(-1, -1), (-1, 1), (1, -1), (1, 1)]

    links = 0
    for i in range(u_count):
        for j in range(v_count):
            idx = (i * v_count) + j
            p = agents[idx].position
            neigh, rests = [], []
            for di, dj in offsets:
                ni, nj = i + di, j + dj
                if ni < 0 or ni >= u_count or nj < 0 or nj >= v_count:
                    continue
                nidx = (ni * v_count) + nj
                d = float(p.DistanceTo(agents[nidx].position))
                if d <= 1e-9:
                    continue
                neigh.append(nidx)
                rests.append(d)
            agents[idx].struct_neighbors = neigh
            agents[idx].struct_rest_lengths = rests
            links += len(neigh)

    return {"enabled": True, "reason": "ok", "u_count": int(u_count), "v_count": int(v_count), "links": int(links)}


class Agent:
    def __init__(self, surface, uv, max_speed):
        self.surface = surface
        self.uv = rg.Point2d(uv.X, uv.Y)
        self.uv0 = rg.Point2d(uv.X, uv.Y)
        self.position = rg.Point3d(surface.PointAt(self.uv.X, self.uv.Y))
        self.velocity = rg.Vector3d(0, 0, 0)
        self.struct_neighbors, self.struct_rest_lengths = [], []

        # Runtime-controlled from agent_simulator (sliders).
        self.base_speed = max(1e-6, float(max_speed))
        self.sep_gain = 0.0
        self.coh_gain = 0.0
        self.base_spacing = 1.0
        self.freedom = 0.0
        self.curv_gain = 0.0
        self.slope_gain = 0.0
        self.struct_spring_gain = 0.0
        self.struct_min_dist_gain = 0.0

        # Fixed internals (kept in builder).
        self.coh_radius_mult = 2.0
        self.momentum = 0.6
        self.curv_speed_k = 1.2
        self.slope_speed_k = 0.9
        self.slope_spacing_k = 0.8
        self.curv_follow_k = 1.5
        self.eps_frac = 0.01
        self.group_slope_gain = 0.55
        self.slope_peer_gain = 0.45
        self.slope_diff_min = 0.04
        self.curv_use_max = True
        self.curv_scale = 0.08
        self.curv_damp = 0.60
        self.slope_damp = 0.25
        self.hardcore_ratio = 0.35
        self.hardcore_boost = 2.0
        self.sep_vec_cap = 3.0
        self.struct_enable = True
        self.struct_min_dist_ratio = 0.70

        self.momentum = clamp01(float(self.momentum))
        self.curv_damp = clamp01(float(self.curv_damp))
        self.slope_damp = clamp01(float(self.slope_damp))
        self._refresh_freedom_gains()
        self.curv_dir = None
        self.curv_mag = 0.0
        self.normal = rg.Vector3d(0, 0, 1)
        self.slope_mag = 0.0
        self.slope_seek = rg.Vector3d(0, 0, 0)

    def _refresh_freedom_gains(self):
        self.home_gain = 0.08 * (1.0 - self.freedom)
        self.noise_gain = 0.002 + (0.012 * self.freedom)

    def apply_runtime_params(self, params):
        if not isinstance(params, dict) or not params:
            return
        if "max_speed" in params:
            self.base_speed = as_float(params["max_speed"], self.base_speed, min_value=1e-6)
        if "sep_gain" in params:
            self.sep_gain = as_float(params["sep_gain"], self.sep_gain, min_value=0.0)
        if "coh_gain" in params:
            self.coh_gain = as_float(params["coh_gain"], self.coh_gain, min_value=0.0)
        if "base_spacing" in params:
            self.base_spacing = as_float(params["base_spacing"], self.base_spacing, min_value=1e-6)
        if "freedom" in params:
            self.freedom = clamp01(as_float(params["freedom"], self.freedom))
        if "curv_gain" in params:
            self.curv_gain = as_float(params["curv_gain"], self.curv_gain, min_value=0.0)
        if "slope_gain" in params:
            self.slope_gain = as_float(params["slope_gain"], self.slope_gain, min_value=0.0)
        if "struct_spring_gain" in params:
            self.struct_spring_gain = as_float(params["struct_spring_gain"], self.struct_spring_gain, min_value=0.0)
        if "struct_min_dist_gain" in params:
            self.struct_min_dist_gain = as_float(params["struct_min_dist_gain"], self.struct_min_dist_gain, min_value=0.0)
        self._refresh_freedom_gains()

    def sense(self, _agents):
        self.curv_dir = None
        self.curv_mag = 0.0
        self.slope_mag = 0.0
        self.slope_seek = rg.Vector3d(0, 0, 0)
        try:
            n = self.surface.NormalAt(self.uv.X, self.uv.Y)
            if not n.IsZero:
                n.Unitize()
            self.normal = n
            z = rg.Vector3d(0, 0, 1)
            self.slope_mag = 1.0 - max(0.0, min(1.0, abs(rg.Vector3d.Multiply(n, z))))

            sc = self.surface.CurvatureAt(self.uv.X, self.uv.Y)
            if sc is not None:
                k0, k1 = abs(sc.Kappa(0)), abs(sc.Kappa(1))
                d0, d1 = sc.Direction(0), sc.Direction(1)
                self.curv_dir, self.curv_mag = ((d0, k0) if k0 >= k1 else (d1, k1)) if self.curv_use_max else ((d0, k0) if k0 <= k1 else (d1, k1))
                if self.curv_dir is not None and self.curv_dir.Length > 1e-9:
                    self.curv_dir.Unitize()
                else:
                    self.curv_dir = None

            du, dv = self.surface.Domain(0), self.surface.Domain(1)
            eps_u = self.eps_frac * (du.T1 - du.T0)
            eps_v = self.eps_frac * (dv.T1 - dv.T0)
            u0, v0, p = self.uv.X, self.uv.Y, self.position
            u_p, u_m = clamp_param(u0 + eps_u, du), clamp_param(u0 - eps_u, du)
            v_p, v_m = clamp_param(v0 + eps_v, dv), clamp_param(v0 - eps_v, dv)

            def slope_at(uq, vq):
                n_q = self.surface.NormalAt(uq, vq)
                if n_q.IsZero:
                    return 0.0
                n_q.Unitize()
                return 1.0 - max(0.0, min(1.0, abs(rg.Vector3d.Multiply(n_q, z))))

            grad_u = slope_at(u_p, v0) - slope_at(u_m, v0)
            grad_v = slope_at(u0, v_p) - slope_at(u0, v_m)
            tu = rg.Vector3d(self.surface.PointAt(u_p, v0) - p)
            tv = rg.Vector3d(self.surface.PointAt(u0, v_p) - p)
            slope_seek = project_to_tangent((tu * grad_u) + (tv * grad_v), n)
            if slope_seek.Length > 1e-9:
                slope_seek.Unitize()
                self.slope_seek = slope_seek
        except:
            self.normal = rg.Vector3d(0, 0, 1)
            self.curv_dir = None
            self.curv_mag = 0.0
            self.slope_mag = 0.0
            self.slope_seek = rg.Vector3d(0, 0, 0)

    def decide(self, agents):
        k = max(0.0, float(self.curv_mag))
        s = max(0.0, min(1.0, float(self.slope_mag)))
        curv_norm = k / (k + max(1e-9, self.curv_scale))
        speed_scale = (1.0 - clamp01(self.curv_damp * curv_norm)) * (1.0 - clamp01(self.slope_damp * s))
        speed_scale /= 1.0 + (0.35 * self.curv_speed_k * curv_norm) + (0.25 * self.slope_speed_k * s)
        speed_scale = max(0.10 + (0.40 * self.freedom), min(1.0, speed_scale))
        speed = self.base_speed * speed_scale

        R = max(1e-6, self.base_spacing * (1.0 + self.slope_spacing_k * s))
        R_coh = R * max(1.0, self.coh_radius_mult)
        hard_core = max(1e-9, self.hardcore_ratio * R)

        sep = rg.Vector3d(0, 0, 0)
        coh_sum = rg.Vector3d(0, 0, 0)
        coh_count = 0
        peer_slope_vec = rg.Vector3d(0, 0, 0)
        local_slope_sum, local_slope_count = s, 1

        for other in agents:
            if other is self:
                continue
            d = self.position.DistanceTo(other.position)
            if d <= 1e-9:
                continue

            if d <= R:
                away = rg.Vector3d(self.position - other.position)
                if away.Length > 1e-9:
                    away.Unitize()
                    falloff = max(0.0, (R - d) / R)
                    if d < hard_core:
                        falloff *= (1.0 + self.hardcore_boost * max(0.0, (hard_core - d) / hard_core))
                    sep += away * falloff

            if d <= R_coh:
                coh_sum += rg.Vector3d(other.position - self.position)
                coh_count += 1
                o_s = getattr(other, "slope_mag", None)
                if o_s is not None:
                    try:
                        o_s_val = max(0.0, min(1.0, float(o_s)))
                        local_slope_sum += o_s_val
                        local_slope_count += 1
                        if o_s_val > (s + self.slope_diff_min):
                            to_other = rg.Vector3d(other.position - self.position)
                            if to_other.Length > 1e-9:
                                to_other.Unitize()
                                w_sd = o_s_val - s
                                w_dist = max(0.0, (R_coh - d) / max(1e-9, R_coh))
                                peer_slope_vec += to_other * (w_sd * w_dist)
                    except:
                        pass

        sep = project_to_tangent(sep, self.normal)
        sep_len = sep.Length
        if sep_len > self.sep_vec_cap and sep_len > 1e-9:
            sep *= (self.sep_vec_cap / sep_len)

        coh = rg.Vector3d(0, 0, 0)
        if coh_count > 0:
            coh = project_to_tangent(rg.Vector3d(coh_sum) * (1.0 / float(coh_count)), self.normal)
            if coh.Length > 1e-9:
                coh.Unitize()
            else:
                coh = rg.Vector3d(0, 0, 0)

        peer_slope = project_to_tangent(peer_slope_vec, self.normal)
        if peer_slope.Length > 1e-9:
            peer_slope.Unitize()
        else:
            peer_slope = rg.Vector3d(0, 0, 0)

        struct_spring = rg.Vector3d(0, 0, 0)
        struct_min_push = rg.Vector3d(0, 0, 0)
        if self.struct_enable:
            n_count = min(len(self.struct_neighbors), len(self.struct_rest_lengths))
            min_ratio = max(0.05, float(self.struct_min_dist_ratio))
            for i in range(n_count):
                oi = int(self.struct_neighbors[i])
                if oi < 0 or oi >= len(agents):
                    continue
                rest = max(1e-6, float(self.struct_rest_lengths[i]))
                to_other = rg.Vector3d(agents[oi].position - self.position)
                d = float(to_other.Length)
                if d <= 1e-9:
                    continue
                to_other.Unitize()
                struct_spring += to_other * ((d - rest) / rest)
                min_d = min_ratio * rest
                if d < min_d:
                    struct_min_push -= to_other * ((min_d - d) / max(1e-9, min_d))
            struct_spring = project_to_tangent(struct_spring, self.normal)
            struct_min_push = project_to_tangent(struct_min_push, self.normal)

        mean_slope = local_slope_sum / float(max(1, local_slope_count))
        sep_group_scale = 1.0 + (self.group_slope_gain * mean_slope)
        coh_group_scale = max(0.35, 1.0 - (0.35 * self.group_slope_gain * mean_slope))

        curv = rg.Vector3d(0, 0, 0)
        if self.curv_dir is not None:
            curv = project_to_tangent(rg.Vector3d(self.curv_dir), self.normal)
            if curv.Length > 1e-9:
                curv.Unitize()
            else:
                curv = rg.Vector3d(0, 0, 0)

        slope = rg.Vector3d(self.slope_seek)
        if slope.Length > 1e-9:
            slope.Unitize()

        home = project_to_tangent(rg.Vector3d(self.surface.PointAt(self.uv0.X, self.uv0.Y) - self.position), self.normal)
        if home.Length > 1e-9:
            home.Unitize()
        else:
            home = rg.Vector3d(0, 0, 0)

        noise = rg.Vector3d(random.uniform(-1.0, 1.0), random.uniform(-1.0, 1.0), random.uniform(-1.0, 1.0))
        noise = project_to_tangent(noise, self.normal)
        if noise.Length > 1e-9:
            noise.Unitize()
        else:
            noise = rg.Vector3d(0, 0, 0)

        move = (
            (sep * (self.sep_gain * sep_group_scale)) + (coh * (self.coh_gain * coh_group_scale)) +
            (peer_slope * self.slope_peer_gain) + (struct_spring * self.struct_spring_gain) +
            (struct_min_push * self.struct_min_dist_gain) +
            (curv * (self.curv_gain * (1.0 + self.curv_follow_k * k))) +
            (slope * self.slope_gain) + (home * self.home_gain) + (noise * self.noise_gain)
        )
        move = project_to_tangent(move, self.normal)

        if self.velocity is not None and self.velocity.Length > 1e-9:
            vdir = project_to_tangent(rg.Vector3d(self.velocity), self.normal)
            if vdir.Length > 1e-9:
                vdir.Unitize()
                move = (move * (1.0 - self.momentum)) + (vdir * self.momentum)

        if move.Length > 1e-9:
            move.Unitize()
        else:
            move = rg.Vector3d(0, 0, 0)

        self.step_len = speed
        self.move_dir = move
        self.rep_radius = R

    def move(self):
        prev = rg.Point3d(self.position)
        if not hasattr(self, "move_dir") or self.move_dir.IsZero:
            self.velocity = rg.Vector3d(0, 0, 0)
            return
        proposed = self.position + self.move_dir * self.step_len
        ok, u2, v2 = self.surface.ClosestPoint(proposed)
        if ok:
            du, dv = self.surface.Domain(0), self.surface.Domain(1)
            u2, v2 = clamp_param(u2, du), clamp_param(v2, dv)
            self.uv = rg.Point2d(u2, v2)
            self.position = rg.Point3d(self.surface.PointAt(u2, v2))
        self.velocity = rg.Vector3d(self.position - prev)

    def update(self, agents, runtime_params=None):
        self.apply_runtime_params(runtime_params)
        self.sense(agents)
        self.decide(agents)
        self.move()


# ---------------------------------------------------------------------------
# AGENT BUILD
# ---------------------------------------------------------------------------
def build_agents_from_seed(surface, seed_points, max_speed):
    pts_raw = iter_any(seed_points)
    pts3 = [p for p in [to_point3d(pt) for pt in pts_raw] if p is not None]

    if not pts3:
        return [], "ERROR: seed_points is empty or invalid (no builder fallback)", []

    agents, uv_keys, pos_keys = [], [], []
    for p3 in pts3:
        ok, u, v = surface.ClosestPoint(p3)
        if not ok:
            continue
        a = Agent(surface, rg.Point2d(u, v), max_speed)
        agents.append(a)
        uv_keys.append((round(u, 6), round(v, 6)))
        pos_keys.append((round(a.position.X, 6), round(a.position.Y, 6), round(a.position.Z, 6)))

    struct_info = assign_structural_links(agents, surface)
    dbg = (
        "seed_raw:{0} seed_valid:{1} agents:{2} unique_uv:{3} unique_pos:{4} unique_seed:{5} "
        "struct:{6} dims:{7}x{8} links:{9}"
    ).format(
        len(pts_raw), len(pts3), len(agents), len(set(uv_keys)), len(set(pos_keys)),
        len(set([(round(p.X, 6), round(p.Y, 6), round(p.Z, 6)) for p in pts3])),
        "on" if bool(struct_info.get("enabled", False)) else "off:" + str(struct_info.get("reason", "na")),
        int(struct_info.get("u_count", 0)), int(struct_info.get("v_count", 0)), int(struct_info.get("links", 0)),
    )
    return agents, dbg, pts3


class MyComponent(Grasshopper.Kernel.GH_ScriptInstance):
    # -----------------------------------------------------------------------
    # GH SCRIPT ENTRY
    # -----------------------------------------------------------------------
    def RunScript(self,
            reset,
            base_surface,
            seed,
            max_speed,
            seed_points: list[object]):
        seed_everything(seed)
        srf = coerce_surface_face(base_surface)
        if reset or not hasattr(self, "agents") or not hasattr(self, "_inited"):
            if srf is None:
                self.agents, self.dbg, self.seed_preview = [], "ERROR: base_surface is None or could not be coerced", []
            else:
                self.agents, self.dbg, self.seed_preview = build_agents_from_seed(srf, seed_points, max_speed)
            self._inited = True

        agents = getattr(self, "agents", [])
        dbg = getattr(self, "dbg", "")
        seed_preview = getattr(self, "seed_preview", [])

        out_count = 1
        try:
            out_count = int(self.Component.Params.Output.Count)
        except:
            out_count = 1

        if out_count <= 1:
            return (agents,)
        if out_count == 2:
            return agents, dbg
        return agents, dbg, seed_preview
# ---------- end agent_builder ----------

srf_2 = Surface(py3.out_surface)

agent_simulator = Python3Script(
    agents=agent_builder,
    step=Button(),
    reset=button,
    max_speed=number_slider_4,
    sep_gain=Slider(1.85, range=0..10),
    coh_gain=Slider(0.7, range=0..1),
    base_spacing=Slider(1.25, range=0..10),
    freedom=Slider(0.75, range=0..1),
    struct_spring_gain=Slider(0.65, range=0..1),
    struct_min_dist_gain=Slider(1.45, range=0..10),
    curv_gain=Slider(0.95, range=0..1),
    slope_gain=Slider(1, range=0..2))  # -> agents, P, V, D; inputs agents: list
# ---------- agent_simulator: Python ----------
import scriptcontext as sc
import Rhino.Geometry as rg

# ---------------------------------------------------------------------------
# INPUT CONTRACT (Grasshopper)
# ---------------------------------------------------------------------------
# Inputs:
# - agents : list[Agent] from agent_builder (preferred)
# - step   : bool. Advances simulation only on rising edge (False->True)
# - reset  : bool (optional). Resets agents to their start UV/position
# Main live force inputs (recommended GH sliders):
# - max_speed
# - sep_gain
# - coh_gain (or cohesion_gain)
# - base_spacing
# - freedom
# - curv_gain
# - slope_gain
# - struct_spring_gain
# - struct_min_dist_gain
#
# Backward compatibility:
# - If `agents` input is not wired, script will try legacy `x.agents`.
#
# Outputs:
# - agents / agents_out : updated agent list
# - P                   : list[Point3d] agent positions
# - V                   : list[Line] velocity vectors
# - D                   : debug string
# ---------------------------------------------------------------------------

# ---------------------------------------------------------------------------
# RUNTIME DEFAULTS (used when sliders are unwired)
# ---------------------------------------------------------------------------
RUNTIME_DEFAULTS = {
    "max_speed": 1.0,
    "sep_gain": 1.85,
    "coh_gain": 0.72,
    "base_spacing": 1.25,
    "freedom": 0.75,
    "curv_gain": 0.45,
    "slope_gain": 0.95,
    "struct_spring_gain": 0.65,
    "struct_min_dist_gain": 1.45,
}

# ---------------------------------------------------------------------------
# HELPERS
# ---------------------------------------------------------------------------
def as_bool(value, default=False):
    if value is None:
        return bool(default)
    if isinstance(value, bool):
        return value
    s = str(value).strip().lower()
    if s in ("1", "true", "t", "yes", "y", "on"):
        return True
    if s in ("0", "false", "f", "no", "n", "off"):
        return False
    return bool(default)


def iter_any(obj):
    if obj is None:
        return []
    try:
        return [x for x in obj]
    except:
        return [obj]


def normalize_agents_input(obj):
    """
    Accept list/tuple/wrapped inputs and return a clean list[Agent]-like objects.
    Handles one-level wrapping such as (agents_list,) from a single-output builder.
    """
    items = iter_any(obj)
    if len(items) == 1:
        only = items[0]
        try:
            nested = [x for x in only]
            if nested and hasattr(nested[0], "update"):
                items = nested
        except:
            pass

    out = []
    for a in items:
        if hasattr(a, "update") and hasattr(a, "position"):
            out.append(a)
    return out


def collect_runtime_params():
    """
    Collect main force parameters from simulator GH inputs.
    Keys are normalized to names used by Agent.apply_runtime_params.
    """
    alias_map = {
        "max_speed": ["max_speed", "max_speed_live", "speed"],
        "sep_gain": ["sep_gain"],
        "coh_gain": ["coh_gain", "cohesion_gain"],
        "base_spacing": ["base_spacing"],
        "freedom": ["freedom"],
        "curv_gain": ["curv_gain"],
        "slope_gain": ["slope_gain"],
        "struct_spring_gain": ["struct_spring_gain"],
        "struct_min_dist_gain": ["struct_min_dist_gain"],
    }

    out = dict(RUNTIME_DEFAULTS)
    for key, aliases in alias_map.items():
        for name in aliases:
            val = globals().get(name, None)
            if val is not None:
                out[key] = val
                break
    return out


# ---------------------------------------------------------------------------
# READ INPUTS
# ---------------------------------------------------------------------------
in_agents = globals().get("agents", None)
if in_agents is None:
    # Legacy fallback: previous setup passed builder component instance as x.
    x = globals().get("x", None)
    if x is not None and hasattr(x, "agents"):
        in_agents = getattr(x, "agents", None)

step_flag = as_bool(globals().get("step", False), False)
reset_flag = as_bool(globals().get("reset", False), False)
runtime_params = collect_runtime_params()


# ---------------------------------------------------------------------------
# STICKY STATE (edge-trigger stepping)
# ---------------------------------------------------------------------------
guid = str(ghenv.Component.InstanceGuid)
k_prev = "A4_prev_step_" + guid
k_prev_reset = "A4_prev_reset_" + guid
k_step = "A4_step_count_" + guid
k_agents = "A4_agents_state_" + guid
k_last_disp = "A4_last_mean_disp_" + guid

if k_prev not in sc.sticky:
    sc.sticky[k_prev] = False
if k_prev_reset not in sc.sticky:
    sc.sticky[k_prev_reset] = False
if k_step not in sc.sticky:
    sc.sticky[k_step] = 0
if k_last_disp not in sc.sticky:
    sc.sticky[k_last_disp] = 0.0

do_step = (step_flag is True) and (sc.sticky[k_prev] is False)
sc.sticky[k_prev] = step_flag

do_reset = (reset_flag is True) and (sc.sticky[k_prev_reset] is False)
sc.sticky[k_prev_reset] = reset_flag

# Persistent agent state lives in sticky and only re-initializes on reset.
if do_reset or (k_agents not in sc.sticky):
    sc.sticky[k_agents] = normalize_agents_input(in_agents)

agents_state = sc.sticky.get(k_agents, [])
if (not agents_state) and in_agents is not None:
    # One-time recovery if sticky got cleared unexpectedly.
    agents_state = normalize_agents_input(in_agents)
    sc.sticky[k_agents] = agents_state

# Apply live slider values every solve so next step always uses latest params.
if agents_state and runtime_params:
    for a in agents_state:
        try:
            if hasattr(a, "apply_runtime_params"):
                a.apply_runtime_params(runtime_params)
        except:
            pass


# ---------------------------------------------------------------------------
# OPTIONAL RESET + SIMULATION STEP
# ---------------------------------------------------------------------------
if do_reset:
    for a in agents_state:
        uv0 = getattr(a, "uv0", None)
        srf = getattr(a, "surface", None)
        if (uv0 is not None) and (srf is not None):
            try:
                a.uv = rg.Point2d(uv0.X, uv0.Y)
                a.position = rg.Point3d(srf.PointAt(uv0.X, uv0.Y))
            except:
                pass

        try:
            a.velocity = rg.Vector3d(0, 0, 0)
        except:
            pass
        try:
            a.age = 0
        except:
            pass
        try:
            a.spawn_cooldown = 0
        except:
            pass

    sc.sticky[k_step] = 0
    sc.sticky[k_last_disp] = 0.0

prev_pos = {}
for a in agents_state:
    p = getattr(a, "position", None)
    if p is not None:
        prev_pos[id(a)] = rg.Point3d(p)

update_fail_count = 0
if do_step and agents_state:
    step_disp_sum = 0.0
    step_disp_count = 0

    for a in agents_state:
        try:
            try:
                a.update(agents_state, runtime_params)
            except TypeError:
                # Backward compatibility with older Agent.update(self, agents).
                a.update(agents_state)
        except:
            # Keep stepping robust if one agent fails.
            update_fail_count += 1

        # Ensure velocity reflects actual displacement this step.
        # This makes V robust even if an Agent implementation does not set velocity.
        p_prev = prev_pos.get(id(a), None)
        p_now = getattr(a, "position", None)
        if p_prev is not None and p_now is not None:
            try:
                a.velocity = rg.Vector3d(rg.Point3d(p_now) - p_prev)
                vlen = float(a.velocity.Length)
                if vlen > 1e-9:
                    step_disp_sum += vlen
                    step_disp_count += 1
            except:
                pass

    sc.sticky[k_step] = int(sc.sticky.get(k_step, 0)) + 1
    if step_disp_count > 0:
        sc.sticky[k_last_disp] = step_disp_sum / float(step_disp_count)
    else:
        sc.sticky[k_last_disp] = 0.0

# Persist updated state for the next solve.
sc.sticky[k_agents] = agents_state


# ---------------------------------------------------------------------------
# OUTPUTS
# ---------------------------------------------------------------------------
P = []
V = []
vel_sum = 0.0
vel_count = 0

for a in agents_state:
    p = getattr(a, "position", None)
    if p is None:
        continue

    p3 = rg.Point3d(p)
    P.append(p3)

    vel = getattr(a, "velocity", None)
    if vel is not None and vel.Length > 1e-9:
        vel_sum += float(vel.Length)
        vel_count += 1
        V.append(rg.Line(p3, p3 + vel))
    else:
        # Fallback display: predicted direction from last decision, if available.
        md = getattr(a, "move_dir", None)
        sl = float(getattr(a, "step_len", 0.0))
        if md is not None and hasattr(md, "Length") and md.Length > 1e-9 and sl > 1e-9:
            md_u = rg.Vector3d(md)
            md_u.Unitize()
            V.append(rg.Line(p3, p3 + (md_u * sl)))

agents = agents_state      # Preferred output name.
agents_out = agents_state  # Alias output name.

D = "agents:{0} step_count:{1} stepped:{2} reset:{3}".format(
    len(agents_state),
    int(sc.sticky.get(k_step, 0)),
    do_step,
    do_reset
)
if update_fail_count > 0:
    D += " update_fail:{0}".format(update_fail_count)
if len(runtime_params) > 0:
    keys = sorted([str(k) for k in runtime_params.keys()])
    preview = ",".join(keys[:6])
    if len(keys) > 6:
        preview += ",..."
    D += " params:{0}[{1}]".format(len(runtime_params), preview)

if vel_count > 0:
    D += " mean_disp:{0:.4f}".format(vel_sum / float(vel_count))
else:
    D += " mean_disp:0.0000"

D += " last_step_disp:{0:.4f}".format(float(sc.sticky.get(k_last_disp, 0.0)))

if len(P) > 0:
    p0 = P[0]
    D += " p0:({0:.3f},{1:.3f},{2:.3f})".format(float(p0.X), float(p0.Y), float(p0.Z))
# ---------- end agent_simulator ----------
panel = Panel(agent_simulator.D)

agent_simulator_2 = Python3Script(
    agents=agent_builder,
    step=Button(),
    reset=button,
    max_speed=number_slider_4,
    sep_gain=Slider(1.85, range=0..10),
    coh_gain=Slider(0.7, range=0..1),
    base_spacing=Slider(1.25, range=0..10),
    freedom=Slider(0.75, range=0..1),
    struct_spring_gain=Slider(0.65, range=0..1),
    struct_min_dist_gain=Slider(1.45, range=0..10))  # -> agents, P, V, D; inputs agents: list; disabled
# ---------- agent_simulator_2: Python ----------
import scriptcontext as sc
import Rhino.Geometry as rg

# ---------------------------------------------------------------------------
# INPUT CONTRACT (Grasshopper)
# ---------------------------------------------------------------------------
# Inputs:
# - agents : list[Agent] from agent_builder (preferred)
# - step   : bool. Advances simulation only on rising edge (False->True)
# - reset  : bool (optional). Resets agents to their start UV/position
# Main live force inputs (recommended GH sliders):
# - max_speed
# - sep_gain
# - coh_gain (or cohesion_gain)
# - base_spacing
# - freedom
# - struct_spring_gain
# - struct_min_dist_gain
#
# Backward compatibility:
# - If `agents` input is not wired, script will try legacy `x.agents`.
#
# Outputs:
# - agents / agents_out : updated agent list
# - P                   : list[Point3d] agent positions
# - V                   : list[Line] velocity vectors
# - D                   : debug string
# ---------------------------------------------------------------------------


def as_bool(value, default=False):
    if value is None:
        return bool(default)
    if isinstance(value, bool):
        return value
    s = str(value).strip().lower()
    if s in ("1", "true", "t", "yes", "y", "on"):
        return True
    if s in ("0", "false", "f", "no", "n", "off"):
        return False
    return bool(default)


def iter_any(obj):
    if obj is None:
        return []
    try:
        return [x for x in obj]
    except:
        return [obj]


def normalize_agents_input(obj):
    """
    Accept list/tuple/wrapped inputs and return a clean list[Agent]-like objects.
    Handles one-level wrapping such as (agents_list,) from a single-output builder.
    """
    items = iter_any(obj)
    if len(items) == 1:
        only = items[0]
        try:
            nested = [x for x in only]
            if nested and hasattr(nested[0], "update"):
                items = nested
        except:
            pass

    out = []
    for a in items:
        if hasattr(a, "update") and hasattr(a, "position"):
            out.append(a)
    return out


def collect_runtime_params():
    """
    Collect main force parameters from simulator GH inputs.
    Keys are normalized to names used by Agent.apply_runtime_params.
    """
    alias_map = {
        "max_speed": ["max_speed", "max_speed_live", "speed"],
        "sep_gain": ["sep_gain"],
        "coh_gain": ["coh_gain", "cohesion_gain"],
        "base_spacing": ["base_spacing"],
        "freedom": ["freedom"],
        "struct_spring_gain": ["struct_spring_gain"],
        "struct_min_dist_gain": ["struct_min_dist_gain"],
    }

    out = {}
    for key, aliases in alias_map.items():
        for name in aliases:
            val = globals().get(name, None)
            if val is not None:
                out[key] = val
                break
    return out


# ---------------------------------------------------------------------------
# Read inputs
# ---------------------------------------------------------------------------
in_agents = globals().get("agents", None)
if in_agents is None:
    # Legacy fallback: previous setup passed builder component instance as x.
    x = globals().get("x", None)
    if x is not None and hasattr(x, "agents"):
        in_agents = getattr(x, "agents", None)

step_flag = as_bool(globals().get("step", False), False)
reset_flag = as_bool(globals().get("reset", False), False)
runtime_params = collect_runtime_params()


# ---------------------------------------------------------------------------
# Sticky state (edge-trigger stepping)
# ---------------------------------------------------------------------------
guid = str(ghenv.Component.InstanceGuid)
k_prev = "A4_prev_step_" + guid
k_prev_reset = "A4_prev_reset_" + guid
k_step = "A4_step_count_" + guid
k_agents = "A4_agents_state_" + guid
k_last_disp = "A4_last_mean_disp_" + guid

if k_prev not in sc.sticky:
    sc.sticky[k_prev] = False
if k_prev_reset not in sc.sticky:
    sc.sticky[k_prev_reset] = False
if k_step not in sc.sticky:
    sc.sticky[k_step] = 0
if k_last_disp not in sc.sticky:
    sc.sticky[k_last_disp] = 0.0

do_step = (step_flag is True) and (sc.sticky[k_prev] is False)
sc.sticky[k_prev] = step_flag

do_reset = (reset_flag is True) and (sc.sticky[k_prev_reset] is False)
sc.sticky[k_prev_reset] = reset_flag

# Persistent agent state lives in sticky and only re-initializes on reset.
if do_reset or (k_agents not in sc.sticky):
    sc.sticky[k_agents] = normalize_agents_input(in_agents)

agents_state = sc.sticky.get(k_agents, [])
if (not agents_state) and in_agents is not None:
    # One-time recovery if sticky got cleared unexpectedly.
    agents_state = normalize_agents_input(in_agents)
    sc.sticky[k_agents] = agents_state

# Apply live slider values every solve so next step always uses latest params.
if agents_state and runtime_params:
    for a in agents_state:
        try:
            if hasattr(a, "apply_runtime_params"):
                a.apply_runtime_params(runtime_params)
        except:
            pass


# ---------------------------------------------------------------------------
# Optional reset + simulation step
# ---------------------------------------------------------------------------
if do_reset:
    for a in agents_state:
        uv0 = getattr(a, "uv0", None)
        srf = getattr(a, "surface", None)
        if (uv0 is not None) and (srf is not None):
            try:
                a.uv = rg.Point2d(uv0.X, uv0.Y)
                a.position = rg.Point3d(srf.PointAt(uv0.X, uv0.Y))
            except:
                pass

        try:
            a.velocity = rg.Vector3d(0, 0, 0)
        except:
            pass
        try:
            a.age = 0
        except:
            pass
        try:
            a.spawn_cooldown = 0
        except:
            pass

    sc.sticky[k_step] = 0
    sc.sticky[k_last_disp] = 0.0

prev_pos = {}
for a in agents_state:
    p = getattr(a, "position", None)
    if p is not None:
        prev_pos[id(a)] = rg.Point3d(p)

update_fail_count = 0
if do_step and agents_state:
    step_disp_sum = 0.0
    step_disp_count = 0

    for a in agents_state:
        try:
            try:
                a.update(agents_state, runtime_params)
            except TypeError:
                # Backward compatibility with older Agent.update(self, agents).
                a.update(agents_state)
        except:
            # Keep stepping robust if one agent fails.
            update_fail_count += 1

        # Ensure velocity reflects actual displacement this step.
        # This makes V robust even if an Agent implementation does not set velocity.
        p_prev = prev_pos.get(id(a), None)
        p_now = getattr(a, "position", None)
        if p_prev is not None and p_now is not None:
            try:
                a.velocity = rg.Vector3d(rg.Point3d(p_now) - p_prev)
                vlen = float(a.velocity.Length)
                if vlen > 1e-9:
                    step_disp_sum += vlen
                    step_disp_count += 1
            except:
                pass

    sc.sticky[k_step] = int(sc.sticky.get(k_step, 0)) + 1
    if step_disp_count > 0:
        sc.sticky[k_last_disp] = step_disp_sum / float(step_disp_count)
    else:
        sc.sticky[k_last_disp] = 0.0

# Persist updated state for the next solve.
sc.sticky[k_agents] = agents_state


# ---------------------------------------------------------------------------
# Outputs
# ---------------------------------------------------------------------------
P = []
V = []
vel_sum = 0.0
vel_count = 0

for a in agents_state:
    p = getattr(a, "position", None)
    if p is None:
        continue

    p3 = rg.Point3d(p)
    P.append(p3)

    vel = getattr(a, "velocity", None)
    if vel is not None and vel.Length > 1e-9:
        vel_sum += float(vel.Length)
        vel_count += 1
        V.append(rg.Line(p3, p3 + vel))
    else:
        # Fallback display: predicted direction from last decision, if available.
        md = getattr(a, "move_dir", None)
        sl = float(getattr(a, "step_len", 0.0))
        if md is not None and hasattr(md, "Length") and md.Length > 1e-9 and sl > 1e-9:
            md_u = rg.Vector3d(md)
            md_u.Unitize()
            V.append(rg.Line(p3, p3 + (md_u * sl)))

agents = agents_state      # Preferred output name.
agents_out = agents_state  # Alias output name.

D = "agents:{0} step_count:{1} stepped:{2} reset:{3}".format(
    len(agents_state),
    int(sc.sticky.get(k_step, 0)),
    do_step,
    do_reset
)
if update_fail_count > 0:
    D += " update_fail:{0}".format(update_fail_count)
if len(runtime_params) > 0:
    keys = sorted([str(k) for k in runtime_params.keys()])
    preview = ",".join(keys[:6])
    if len(keys) > 6:
        preview += ",..."
    D += " params:{0}[{1}]".format(len(runtime_params), preview)

if vel_count > 0:
    D += " mean_disp:{0:.4f}".format(vel_sum / float(vel_count))
else:
    D += " mean_disp:0.0000"

D += " last_step_disp:{0:.4f}".format(float(sc.sticky.get(k_last_disp, 0.0)))

if len(P) > 0:
    p0 = P[0]
    D += " p0:({0:.3f},{1:.3f},{2:.3f})".format(float(p0.X), float(p0.Y), float(p0.Z))
# ---------- end agent_simulator_2 ----------
pt = Point(agent_simulator.P)
mesh_formation = Python3Script(run=Toggle(True), base_surface=py3.out_surface, points=pt)  # -> out_edges, out_mesh, dbg; inputs points: list of Point3d
# ---------- mesh_formation: Python ----------
import Rhino.Geometry as rg
import rhinoscriptsyntax as rs

# ---------------------------------------------------------------------------
# INPUT CONTRACT (Grasshopper)
# ---------------------------------------------------------------------------
# Inputs:
# - run          : bool. When False, no mesh is generated.
# - base_surface : Surface/BrepFace/Brep (if Brep, first face is used)
# - points       : moving points (typically simulator P output)
#
# Outputs:
# - out_mesh  : dynamic triangle mesh (UV Delaunay rebuilt each solve)
# - out_edges : mesh boundary lines
# - dbg       : debug string
# ---------------------------------------------------------------------------


# ---------------------------------------------------------------------------
# Helpers
# ---------------------------------------------------------------------------
def _is_point_like(x):
    if x is None:
        return False
    if isinstance(x, rg.Point3d):
        return True
    if hasattr(x, "position"):
        return True
    if hasattr(x, "Location"):
        return True
    if hasattr(x, "X") and hasattr(x, "Y") and hasattr(x, "Z"):
        return True
    return False


def _flatten_any(obj, out):
    if obj is None:
        return
    if _is_point_like(obj):
        out.append(obj)
        return
    if isinstance(obj, (str, bytes)):
        out.append(obj)
        return
    try:
        items = list(obj)
    except:
        out.append(obj)
        return
    if len(items) == 0:
        return
    for it in items:
        _flatten_any(it, out)


def as_list(x):
    """
    Deep-flatten common GH wrappers/data-tree-like nesting into a point-candidate list.
    """
    out = []
    _flatten_any(x, out)
    return out


def as_bool(v, default=False):
    if v is None:
        return bool(default)
    if isinstance(v, bool):
        return v
    s = str(v).strip().lower()
    if s in ("1", "true", "t", "yes", "y", "on"):
        return True
    if s in ("0", "false", "f", "no", "n", "off"):
        return False
    return bool(default)


def clamp01(x):
    if x < 0.0:
        return 0.0
    if x > 1.0:
        return 1.0
    return x


def clamp(v, lo, hi):
    if v < lo:
        return lo
    if v > hi:
        return hi
    return v


def to_point3d(obj):
    """
    Robust point coercion for GH wiring variants:
    - Point3d / point-like objects
    - wrapped objects with .Location
    - Agent objects with .position
    """
    if obj is None:
        return None

    # Agent-like object from simulator/builder.
    if hasattr(obj, "position"):
        try:
            return rg.Point3d(obj.position)
        except:
            pass

    p = getattr(obj, "Location", obj)
    try:
        return rg.Point3d(p)
    except:
        pass
    try:
        return rg.Point3d(float(p.X), float(p.Y), float(p.Z))
    except:
        return None


def coerce_face(base_surface):
    srf = getattr(base_surface, "Geometry", base_surface)

    try:
        import System
        if isinstance(srf, System.Guid):
            srf = rs.coercesurface(srf) or rs.coercebrep(srf)
    except:
        pass

    if isinstance(srf, rg.Brep):
        if srf.Faces.Count == 0:
            return None
        srf = srf.Faces[0]

    if not isinstance(srf, (rg.Surface, rg.BrepFace)):
        return None

    return srf


def project_points_to_uv(surface, pts):
    uv = []
    valid_pts = []
    bad = 0
    for p in pts:
        p3 = to_point3d(p)
        if p3 is None:
            bad += 1
            continue

        ok, u, v = surface.ClosestPoint(p3)
        if not ok:
            bad += 1
            continue

        uv.append((float(u), float(v)))
        valid_pts.append(p3)

    return uv, valid_pts, bad


def collect_mesh_edges(mesh):
    edge_set = set()
    for f in mesh.Faces:
        if f.IsTriangle:
            pairs = ((f.A, f.B), (f.B, f.C), (f.C, f.A))
        else:
            pairs = ((f.A, f.B), (f.B, f.C), (f.C, f.D), (f.D, f.A))
        for i, j in pairs:
            if i > j:
                i, j = j, i
            edge_set.add((i, j))
    return edge_set


def orient_triangle_faces_up(mesh):
    """
    Enforce upward (+Z) winding for triangle faces.
    """
    verts = mesh.Vertices
    for fi in range(mesh.Faces.Count):
        f = mesh.Faces[fi]
        if not f.IsTriangle:
            continue
        a = int(f.A)
        b = int(f.B)
        c = int(f.C)
        pa = rg.Point3d(verts[a].X, verts[a].Y, verts[a].Z)
        pb = rg.Point3d(verts[b].X, verts[b].Y, verts[b].Z)
        pc = rg.Point3d(verts[c].X, verts[c].Y, verts[c].Z)
        n = rg.Vector3d.CrossProduct(rg.Vector3d(pb - pa), rg.Vector3d(pc - pa))
        if n.Z < 0.0:
            mesh.Faces.SetFace(fi, a, c, b)


# -----------------------
# Delaunay triangulation (UV)
# -----------------------
def orient2d(ax, ay, bx, by, cx, cy):
    return (bx - ax) * (cy - ay) - (by - ay) * (cx - ax)


def circumcircle_contains(ax, ay, bx, by, cx, cy, px, py):
    ax -= px
    ay -= py
    bx -= px
    by -= py
    cx -= px
    cy -= py

    a2 = ax * ax + ay * ay
    b2 = bx * bx + by * by
    c2 = cx * cx + cy * cy

    det = (ax * (by * c2 - b2 * cy) -
           ay * (bx * c2 - b2 * cx) +
           a2 * (bx * cy - by * cx))
    return det > 1e-12


def delaunay_triangulate_2d(pts):
    n = len(pts)
    if n < 3:
        return []

    xs = [p[0] for p in pts]
    ys = [p[1] for p in pts]
    minx, maxx = min(xs), max(xs)
    miny, maxy = min(ys), max(ys)
    dmax = max(maxx - minx, maxy - miny)
    if dmax == 0.0:
        return []

    mx = 0.5 * (minx + maxx)
    my = 0.5 * (miny + maxy)

    p0 = (mx - 20 * dmax, my - dmax)
    p1 = (mx, my + 20 * dmax)
    p2 = (mx + 20 * dmax, my - dmax)

    pts_ext = pts + [p0, p1, p2]
    s0, s1, s2 = n, n + 1, n + 2
    tris = [(s0, s1, s2)]

    for i in range(n):
        px, py = pts_ext[i]
        bad = []

        for t in tris:
            ia, ib, ic = t
            ax, ay = pts_ext[ia]
            bx, by = pts_ext[ib]
            cx, cy = pts_ext[ic]

            if orient2d(ax, ay, bx, by, cx, cy) < 0.0:
                bx, by, cx, cy = cx, cy, bx, by

            if circumcircle_contains(ax, ay, bx, by, cx, cy, px, py):
                bad.append(t)

        edge_count = {}

        def add_edge(a, b):
            if a > b:
                a, b = b, a
            edge_count[(a, b)] = edge_count.get((a, b), 0) + 1

        for ia, ib, ic in bad:
            add_edge(ia, ib)
            add_edge(ib, ic)
            add_edge(ic, ia)

        if bad:
            bad_set = set(bad)
            tris = [t for t in tris if t not in bad_set]

        boundary = [e for e, c in edge_count.items() if c == 1]
        for a, b in boundary:
            tris.append((a, b, i))

    out = []
    for a, b, c in tris:
        if a >= n or b >= n or c >= n:
            continue
        if a == b or b == c or c == a:
            continue
        out.append((a, b, c))

    return out


# ---------------------------------------------------------------------------
# Main
# ---------------------------------------------------------------------------
out_mesh = None
out_edges = []
dbg = ""

run_flag = as_bool(globals().get("run", True), True)

if not run_flag:
    dbg = "run is False"
else:
    srf = coerce_face(globals().get("base_surface", None))
    pts = as_list(globals().get("points", None))

    if srf is None:
        dbg = "ERROR: base_surface is invalid"
    elif len(pts) < 3:
        dbg = "ERROR: need at least 3 points"
    else:
        uv_pts, valid_pts, bad = project_points_to_uv(srf, pts)
        n = len(uv_pts)

        if n < 3:
            dbg = "ERROR: <3 valid projected points (bad={})".format(bad)
        else:
            dom_u = srf.Domain(0)
            dom_v = srf.Domain(1)
            du = float(dom_u.T1 - dom_u.T0)
            dv = float(dom_v.T1 - dom_v.T0)
            if du == 0.0 or dv == 0.0:
                dbg = "ERROR: surface domain is degenerate"
            else:
                # Option 1: dynamic topology. Rebuild Delaunay connectivity every solve.
                uv_norm = []
                for (u, v) in uv_pts:
                    un = clamp01((u - float(dom_u.T0)) / du)
                    vn = clamp01((v - float(dom_v.T0)) / dv)
                    uv_norm.append((un, vn))

                tris = delaunay_triangulate_2d(uv_norm)
                if len(tris) == 0:
                    dbg = "ERROR: dynamic triangulation returned 0 triangles"
                else:
                    mesh = rg.Mesh()
                    for (u, v) in uv_pts:
                        u_clamp = clamp(u, float(dom_u.T0), float(dom_u.T1))
                        v_clamp = clamp(v, float(dom_v.T0), float(dom_v.T1))
                        mesh.Vertices.Add(srf.PointAt(u_clamp, v_clamp))

                    for (a, b, c) in tris:
                        mesh.Faces.AddFace(int(a), int(b), int(c))

                    orient_triangle_faces_up(mesh)
                    mesh.Normals.ComputeNormals()
                    mesh.Compact()
                    out_mesh = mesh

                    edge_set = collect_mesh_edges(mesh)
                    for i, j in edge_set:
                        out_edges.append(rg.Line(mesh.Vertices[i], mesh.Vertices[j]))

                    dbg = "OK(dynamic_tris_up): input:{} valid:{} bad:{} tris:{} edges:{} topology:rebuilt".format(
                        len(pts), n, bad, mesh.Faces.Count, len(edge_set)
                    )
# ---------- end mesh_formation ----------
panel_2 = Panel(mesh_formation.dbg)

crv = Curve([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])
pt_2 = Point([Point(97.94548643, 194.2225123, 30.71535174), Point(97.94548567, 195.8270399, 31.59406165), Point(97.94548567, 197.4027131, 31.1492622), Point(97.9720937, 198.9706385, 30.31247231), Point(97.94548599, 200.5829167, 29.94212449), Point(98.03998556, 202.2203207, 30.79363889)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])
geo = Geometry(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)
X = UnitX(Factor=Slider(260, range=0..1000))
move_2 = Move(Geometry=crv, Motion=X)  # -> Geometry, Transform
move_3 = Move(Geometry=geo, Motion=X)  # -> Geometry, Transform
move_4 = Move(Geometry=pt_2, Motion=X)  # -> Geometry, Transform
preview = CustomPreview(Geometry=move_3.Geometry, Material=ColourSwatch(SwatchColor=RGB(163, 163, 163)))
preview_2 = CustomPreview(Geometry=move_2.Geometry, Material=ColourSwatch(SwatchColor=RGB(107, 107, 107)))
dots = DotDisplay(Point=move_4.Geometry, Colour=ColourSwatch(SwatchColor=RGB(0, 0, 0)), Size=Slider(0.2, range=0..1))

geo_2 = Geometry(mesh_formation.out_mesh)
crv_2 = Curve(mesh_formation.out_edges)
pt_3 = Point(pt)
X_2 = UnitX(Factor=Slider(197, range=0..1000))
move_5 = Move(Geometry=geo_2, Motion=X_2)  # -> Geometry, Transform
move_6 = Move(Geometry=pt_3, Motion=X_2)  # -> Geometry, Transform
move_7 = Move(Geometry=crv_2, Motion=X_2)  # -> Geometry, Transform
preview_3 = CustomPreview(Geometry=move_5.Geometry, Material=ColourSwatch(SwatchColor=RGB(163, 163, 163)))
preview_4 = CustomPreview(Geometry=move_7.Geometry, Material=ColourSwatch(SwatchColor=RGB(107, 107, 107)))
dots_2 = DotDisplay(Point=move_6.Geometry, Colour=ColourSwatch(SwatchColor=RGB(255, 0, 0)), Size=Slider(0.2, range=0..1))

srf_cp = SurfaceClosestPoint(Point=move_4.Geometry, Surface=move_3.Geometry)  # -> Point, UVPoint, Distance
demesh = DeconstructMesh(Mesh=move_5.Geometry)  # -> Vertices, Faces, Colours, Normals
py3_2 = Python3Script(M=move_5.Geometry)  # -> V, K; inputs M: Mesh
# ---------- py3_2: Python ----------
import Rhino.Geometry as rg
import math

V = []
K = []

if M is None or (not isinstance(M, rg.Mesh)) or M.Vertices.Count == 0:
    pass
else:
    m = M.DuplicateMesh()
    m.UnifyNormals()
    m.FaceNormals.ComputeFaceNormals()

    tv = m.TopologyVertices
    k_top = [0.0] * tv.Count

    # Curvature proxy = average angular deviation of incident face normals
    for ti in range(tv.Count):
        faces = tv.ConnectedFaces(ti)
        if not faces:
            continue

        normals = []
        nsum = rg.Vector3d(0, 0, 0)

        for fi in faces:
            n = rg.Vector3d(m.FaceNormals[fi])
            if n.IsZero:
                continue
            n.Unitize()
            normals.append(n)
            nsum += n

        if not normals:
            continue

        nbar = rg.Vector3d(nsum)
        if nbar.IsZero:
            continue
        nbar.Unitize()

        s = 0.0
        for n in normals:
            d = max(-1.0, min(1.0, rg.Vector3d.Multiply(n, nbar)))
            s += math.acos(d)

        k_top[ti] = s / float(len(normals))

    for vi in range(m.Vertices.Count):
        ti = tv.TopologyVertexIndex(vi)
        K.append(k_top[ti])
        vv = m.Vertices[vi]
        V.append(rg.Point3d(vv.X, vv.Y, vv.Z))
# ---------- end py3_2 ----------
curvature = SurfaceCurvature(Surface=move_3.Geometry, Point=srf_cp.UVPoint)  # -> Frame, Gaussian, Mean
bounds = Bounds(Numbers=curvature.Mean)
bounds_2 = Bounds(Numbers=py3_2.K)
dedomain = DeconstructDomain(Domain=bounds_2)  # -> Start, End
dedomain_2 = DeconstructDomain(Domain=bounds)  # -> Start, End
gradient = Gradient(
    LowerLimit=dedomain_2.Start,
    UpperLimit=dedomain_2.End,
    Parameter=curvature.Mean,
    stops=[0.039: RGB(78, 245, 117), 0.319: RGB(0, 119, 255), 0.683: RGB(191, 34, 170), 1: RGB(220, 0, 40)])
gradient_2 = Gradient(
    LowerLimit=dedomain.Start,
    UpperLimit=dedomain.End,
    Parameter=py3_2.K,
    stops=[0.039: RGB(78, 245, 117), 0.319: RGB(0, 119, 255), 0.683: RGB(191, 34, 170), 1: RGB(220, 0, 40)])
preview_5 = CustomPreview(Geometry=demesh.Vertices, Material=gradient_2)
preview_6 = CustomPreview(Geometry=srf_cp.Point, Material=gradient)
